# Grasshopper definition 2D Chladni Pattern.gh (Grasshopper 1.0.7)
# plug-ins: MeshEdit Components, Human, Volvox, froGH, Anemone

# ----
# 2D Chladni Pattern
# Temporary code by Andrea Graziano
# 
# © Co-de-iT 2023 _ Creative Commons Attribution-NonCommercial-ShareAlike 4.0 International License
# Reference:
# Chladni Plate Mathematics, 2D
# Written by Paul Bourke
# March 2003
# http://paulbourke.net/geometry/chladni/
panel = Panel("1")
panel_2 = Panel("Cos((n*Pi*x)/L)*Cos((m*Pi*y)/L)-(Cos(m*Pi*x)/L)*Cos((n*Pi*y)/L)")
rectangle = Rectangle(Plane=PlaneXY(0, 0, 0), XSize=panel, YSize=panel, Radius=0)  # -> Rectangle, Length
sdivide = DivideSurface(Surface=rectangle.Rectangle, UCount="200", VCount="200")  # -> flatten(Points), Normals, Parameters
m = Slider(2, range=1..10)
n = Slider(7, range=1..10)
pdecon = Deconstruct(Point=sdivide.Points)  # -> XComponent, YComponent, ZComponent
eval = Evaluate(F=panel_2, x=pdecon.XComponent, y=pdecon.YComponent, L="1", m=m, n=n)
abs = Absolute(Value=eval)
bnd = Bounds(Numbers=abs)
dedomain = DeconstructDomain(Domain=bnd)  # -> Start, End
gradient = Gradient(LowerLimit=dedomain.End, UpperLimit=dedomain.Start, Parameter=abs, stops=[0: RGB(255, 255, 255), 1: RGB(0, 0, 0)])
number_slider = Slider(0.1, range=0..1)
neg = Negative(Value=number_slider)
expression = Expression(x="200", Expression="x+1")
pt = ConstructPoint(XCoordinate=pdecon.XComponent, YCoordinate=pdecon.YComponent, ZCoordinate=0)
pt_2 = ConstructPoint(XCoordinate=pdecon.XComponent, YCoordinate=pdecon.YComponent, ZCoordinate=eval)
pt_3 = ConstructPoint(XCoordinate=0, YCoordinate=0, ZCoordinate=[neg, number_slider])
number_slider_2 = Slider(0.1, range=0..1)
frompoints = MeshFromPoints(Points=pt, UDirection=expression, VDirection=expression, Colour=gradient)
frompoints_2 = MeshFromPoints(Points=pt_2, UDirection=expression, VDirection=expression)
xy = XYPlane(Origin=pt_3)
sec = MeshPlane(Mesh=frompoints_2, Plane=xy)
smaller = SmallerThan(FirstNumber=abs, SecondNumber=number_slider_2)  # -> SmallerThan, OrEqualTo
dispatch = Dispatch(List=sdivide.Points, DispatchPattern=smaller.SmallerThan)  # -> ListA, ListB
dispatch_2 = Dispatch(List=gradient, DispatchPattern=smaller.SmallerThan)  # -> ListA, ListB
panel_3 = Panel("""0,0,0
0,1.2,0
1.2,1.2,0
1.2,0,0""")
cloud = ConstructCloud(Points=dispatch.ListA, Colors=dispatch_2.ListA)
move = Move(Geometry=rectangle.Rectangle, Motion=panel_3)  # -> Geometry, Transform

format = Format(Format="m={0}, n={1}, l={2}", Culture=127, Data0=m, Data1=n, Data2="1")
tag = TextTag3D(Location="0,1.1,0", Text=format, Size="0.04", Colour=ColourSwatch(SwatchColor=RGB(89, 89, 89)), Justification=4)

# ----
# N.B.  this definition uses the following plugins:
# - MeshEdit2000
# - Human
# -Volvox
# - Anemone
# - froGH
number_slider_3 = Slider(40, range=0..200)
f_crtree = CreateRTree(SourceData=sdivide.Points)
division = Division(A=panel, B="200")
pop2d = Populate2D(Region=rectangle.Rectangle, Count="5000", Seed=1)
loop_start = LoopStart(Repeat=number_slider_3, Trigger=Button(), Data=pop2d)  # -> port, Counter, Data
f_ptssphrt = PointsInSphereRTree(SphereCenter=loop_start.Data, SearchRadius=division, RTree=f_crtree)  # -> Points, PointsIndices
item = ListItem(List=abs, Index=f_ptssphrt.PointsIndices, Wrap=True)
panel_4 = Panel(loop_start.Counter)
sort = SortList(Keys=item, ValuesA=f_ptssphrt.PointsIndices)  # -> Keys, ValuesA
graft = GraftTree(Tree=loop_start.Data, IncludeEmptyLists=True, IncludeNullItems=True)
item_2 = ListItem(List=sort.ValuesA, Index=0, Wrap=True)
item_3 = ListItem(List=sort.Keys, Index=0, Wrap=True)
item_4 = ListItem(List=sdivide.Points, Index=item_2, Wrap=True)
smaller_2 = SmallerThan(FirstNumber=item_3, SecondNumber=number_slider_2)  # -> SmallerThan, OrEqualTo
vec2pt = Vector2Pt(PointA=graft, PointB=item_4, Unitize=False)  # -> Vector, Length
panel_5 = Panel("0.002")
weave = Weave(Pattern=smaller_2.OrEqualTo, Stream0=division, Stream1="0", NullGaps=False)
amp = Amplitude(Vector=vec2pt.Vector, Amplitude=weave)
move_2 = Move(Geometry=graft, Motion=amp)  # -> Geometry, Transform
loop_end = LoopEnd(
    port=loop_start.port,
    Exit=False,
    Data=flatten(move_2.Geometry),
    TimeOutVal=0,
    pausedState=False,
    state="Constant output")
dup = DuplicateData(Data=ColourSwatch(SwatchColor=RGB(89, 89, 89)), Number="5000", Order=True)
cloud_2 = ConstructCloud(Points=loop_end, Colors=dup)

move_3 = Move(Geometry=sec, Motion="0,1.2,0")  # -> Geometry, Transform
move_4 = Move(Geometry=frompoints, Motion="1.2,1.2,0")  # -> Geometry, Transform
move_5 = Move(Geometry=cloud, Motion="1.2,0,0")  # -> Geometry, Transform

previewlw = CustomPreviewLineweights(
    Geometry=[move_3.Geometry, move.Geometry],
    Shader=ColourSwatch(SwatchColor=RGB(89, 89, 89)),
    Thickness=Slider(3, range=0..10),
    Absolute=False)
