# Grasshopper definition Cellular automata.gh (Grasshopper 1.0.7)
# plug-ins: Mesh Pipe, Anemone

# ---- group: Starting point grid
# Cellular Automata
# Temporary code by Andrea Graziano
# 
# © Co-de-iT 2023
panel = Panel("1")
series = Series(Start=0, Step=panel, Count="25")
crossref = CrossReference(ListA=series, ListB=series, CrossMode=1)  # -> ListA, ListB
pt = ConstructPoint(XCoordinate=crossref.ListA, YCoordinate=crossref.ListB, ZCoordinate=0)

# ---- group: Grid
crv = Curve([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])
preview = CustomPreview(Geometry=crv, Shader=ColourSwatch(SwatchColor=RGB(66, 66, 66)))

# ---- group: Background
mesh = Mesh(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)
mcol = MeshColours(Mesh=mesh, Colours=ColourSwatch(SwatchColor=RGB(217, 217, 217)))
preview_2 = CustomPreview(Geometry=mcol, Shader=ColourSwatch(SwatchColor=RGB(255, 255, 255)))

# ---- group: Randomic initial state
lng = ListLength(List=pt)
random = Random(Range=Domain(0, 1), Number=lng, Seed=Slider(3, range=0..20), Integers=True)

# ----
# N.B.  this definition uses the following plugins:
# - Anemone by Mateusz Zwierzycki
# - MeshTools by Mateusz Zwierzycki
slider = Slider(49, range=0..49)
# D0 >> Initial state
# D1 >> Recorded points
loop_start = LoopStart(N=slider, T=Button(), D0=random)  # -> port, Counter, Data, Data_2
pdecon = Deconstruct(Point=pt)  # -> XComponent, YComponent, ZComponent
pt_2 = ConstructPoint(XCoordinate=pdecon.XComponent, YCoordinate=pdecon.YComponent, ZCoordinate=loop_start.Counter)

# ---- group: Neighbors state
prox = Proximity2D(Points=pt, Plane=PlaneXY(0, 0, 0), Group="8", MaxRadius="1.5")  # -> Links, Topology

# ----
item = ListItem(List=loop_start.Data, Index=prox.Topology, Wrap=True)

# ---- group: Neighbors state (continued)
ma = MassAddition(Input=item)  # -> flatten(Result), PartialResults

# ---- group: Game of life rules
expression = Expression(x=loop_start.Data, n=ma.Result, Expression="if(x=0,if(n=3,1,0),if(n=3,1,if(n=2,1,0)))")

# ----
dispatch = Dispatch(List=pt_2, DispatchPattern=expression)  # -> ListA, ListB
merge = Merge(Data1=flatten(loop_start.Data_2), Data2=flatten(dispatch.ListA))
loop_end = LoopEnd(
    port=loop_start.port,
    Exit=False,
    Data=expression,
    Data_2=merge,
    TimeOutVal=0,
    pausedState=False,
    state="Constant output")  # -> D0, D1
voxel = Voxel(Points=loop_end.D1, X=1, Y=1, Z=1)
mcol_2 = MeshColours(Mesh=voxel, Colours=ColourSwatch(SwatchColor=RGB(30, 98, 214)))
preview_3 = CustomPreview(Geometry=mcol_2, Shader=ColourSwatch(SwatchColor=RGB(255, 255, 255)))
