# Grasshopper definition Climate Pulse DSST.gh (Grasshopper 1.0.7)
# plug-ins: Human, froGH

# ---- group: Parsing Data
# Clmate Pulse DSST
# Temporary code by Andrea Graziano
# 
# © Co-de-iT 2023 _ Creative Commons Attribution-NonCommercial-ShareAlike 4.0 International License
# Daily Sea Surface Temperature [Data: ERA5]
# Data source:
# https://pulse.climate.copernicus.eu/
# https://sites.ecmwf.int/data/climatepulse/data/series/era5_daily_series_sst_60S-60N_ocean.csv
panel = Panel("https://sites.ecmwf.int/data/climatepulse/data/series/era5_daily_series_sst_60S-60N_ocean.csv")
f_urlr = ReadFileFromURL(URLAddress=panel, ByLine=Toggle(True))
split = SplitList(List=f_urlr, Index="18")  # -> ListA, ListB
split_2 = SplitList(List=split.ListB, Index="1")  # -> ListA, ListB
len = TextLength(Text=split_2.ListB)
equals = Equality(FirstNumber=len, SecondNumber="0")  # -> Equality, Inequality
# N.B.  this definition uses the following plugins:
# - Human
# - froGH
split_3 = TextSplit(Text=split_2.ListA, Separators=",")
dispatch = Dispatch(List=split_2.ListB, DispatchPattern=equals.Equality)  # -> ListA, ListB
panel_2 = Panel(split_3)
split_4 = TextSplit(Text=dispatch.ListB, Separators=",")
item = ListItem(List=split_4, Index=0, Wrap=True)  # -> Item, Item1, Item2, Item3, Item4
split_5 = TextSplit(Text=item.Item, Separators="-")  # -> simplify(Result)
item_2 = ListItem(List=split_5, Index=0, Wrap=True)  # -> flatten(Item)
cset = CreateSet(List=item_2)  # -> Set, Map
mindex = MemberIndex(Set=item_2, Member=cset.Set)  # -> simplify(Index), Count
graft = GraftTree(Tree=cset.Set, IncludeEmptyLists=True, IncludeNullItems=True)
item_3 = ListItem(List=flatten(item.Item1), Index=mindex.Index, Wrap=True)

# ---- group: Diagram Vectors
division = Division(A="2*Pi", B="365")
series = Series(Start=0, Step=expr("-x", division), Count=expr("x+1", "365"))
X = UnitX(Factor=1)
rotate = Rotate(Geometry=X, Angle=series, Plane=PlaneXY(0, 0, 0))  # -> Geometry, Transform
vec = Vector(rotate.Geometry)

# ---- group: Diagram Size
domain = Domain("70 to 150")

# ---- group: Diagram Center
pt = Point("0,0,0")

# ---- group: Parsing Data / Year
txt = Text(simplify(graft))

# ---- group: Parsing Data / Temps
num = Number(simplify(item_3))

# ---- group: Preparing Data Structure
num_2 = Number(num)
lng = ListLength(List=num_2)
equals_2 = Equality(FirstNumber=num_2, SecondNumber="0")  # -> Equality, Inequality
expression = Expression(x=lng, Expression="x-1")
subset = SubList(List=vec, Domain=expression, Wrap=True)  # -> List, Index
dispatch_2 = Dispatch(List=num_2, DispatchPattern=equals_2.Inequality)  # -> ListA, ListB
repeat = RepeatData(Data=pt, Length=lng)
pt_2 = Point(simplify(repeat))
vec_2 = Vector(simplify(subset.List))
num_3 = Number(simplify(dispatch_2.ListA))

# ---- group: Remapped values, points & curves
num_4 = Number(num_3)
vec_3 = Vector(vec_2)
pt_3 = Point(pt_2)
panel_3 = Panel("""19.5
20
20.5
21
21.5""")
bnd = Bounds(Numbers=panel_3)
remap = RemapNumbers(Value=panel_3, Source=bnd, Target=domain)  # -> Mapped, Clipped
remap_2 = RemapNumbers(Value=num_4, Source=bnd, Target=domain)  # -> Mapped, Clipped
amp = Amplitude(Vector=vec_3, Amplitude=remap_2.Mapped)
move = Move(Geometry=pt_3, Motion=amp)  # -> simplify(Geometry), Transform
pline = PolyLine(Vertices=move.Geometry, Closed=False)  # -> simplify(Polyline)

# ---- group: Years
txt_2 = Text(txt)

# ---- group: Temp values
num_5 = Number(num_4)

# ---- group: Polylines
crv = Curve(pline)

# ---- group: Remapped values
num_6 = Number(remap_2.Mapped)

# ---- group: Radial Diagram / Months VIZ
division_2 = Division(A="2*Pi", B="12")
series_2 = Series(Start=0, Step=expr("-x", division_2), Count="12")
X_2 = UnitX(Factor=1)
rotate_2 = Rotate(Geometry=X_2, Angle=series_2, Plane=PlaneXY(0, 0, 0))  # -> Geometry, Transform
dedomain = DeconstructDomain(Domain=domain)  # -> Start, End
pt_4 = Point(pt)
amp_2 = Amplitude(Vector=rotate_2.Geometry, Amplitude=dedomain.Start)
subtraction = Subtraction(A=dedomain.End, B=dedomain.Start)
move_2 = Move(Geometry=pt_4, Motion=amp_2)  # -> Geometry, Transform
line = LineSDL(Start=move_2.Geometry, Direction=amp_2, Length=subtraction)
move_3 = Move(Geometry=line, Motion=Vector(0, 0, 10))  # -> Geometry, Transform
end = EndPoints(Curve=line)  # -> Start, End
amp_3 = Amplitude(Vector=line, Amplitude="-4")
panel_4 = Panel("""Jan
Feb
Mar
Apr
May
Jun
Jul
Aug
Sep
Oct
Nov
Dec""")
move_4 = Move(Geometry=end.End, Motion=amp_3)  # -> Geometry, Transform
panel_5 = Panel("""1.5
1.5""")
dash = DashPattern(Curve=move_3.Geometry, Pattern=panel_5)  # -> Dashes, Gaps
rotate_3 = Rotate(Geometry=move_4.Geometry, Angle="-Pi/12", Plane=pt_4)  # -> Geometry, Transform
concat = Concatenate(FragmentA="  ", FragmentB=panel_4)
swatch = ColourSwatch(SwatchColor=RGB(120, 120, 120))
previewlw = CustomPreviewLineweights(Geometry=dash.Dashes, Shader=swatch, Thickness="0.1", Absolute=Toggle(True))
tag = TextTag3D(Location=rotate_3.Geometry, Text=concat, Size="2", Colour=swatch, Justification=5)

# ---- group: Curve colors
tstat = TreeStatistics(Tree=crv)  # -> Paths, Length, Count
dpath = DeconstructPath(Branch=tstat.Paths)  # -> flatten(Indices)
gradient = Gradient(LowerLimit=0, UpperLimit=expr("x-1", tstat.Count), Parameter=dpath, stops=[0: RGB(224, 224, 224), 1: RGB(0, 0, 0)])
panel_6 = Panel("""-4
-3
-2""")
swatch_2 = ColourSwatch(SwatchColor=RGB(255, 0, 0))
swatch_3 = ColourSwatch(SwatchColor=RGB(105, 105, 105))
replace = ReplaceItems(
    List=gradient,
    Item=[ColourSwatch(SwatchColor=RGB(255, 156, 0)), ColourSwatch(SwatchColor=RGB(255, 103, 0)), ColourSwatch(SwatchColor=RGB(255, 1, 0))],
    Indices=panel_6,
    Wrap=Toggle(True))

# ---- group: Diagram Pts
f_cdom = CenteredDomain(DomainLength="120")
dedomain_2 = DeconstructDomain(Domain=f_cdom)  # -> Start, End
X_3 = UnitX(Factor=[dedomain_2.Start, dedomain_2.End])
num_7 = Number(remap.Mapped)
move_5 = Move(Geometry=pt, Motion=X_3)  # -> Geometry, Transform
multiplication = Multiplication(A=num_6, B="0.3")
multiplication_2 = Multiplication(A=num_7, B="0.3")
item_4 = ListItem(List=move_5.Geometry, Index=0, Wrap=True)  # -> Item, Item1
avr = Average(Input=multiplication)  # -> flatten(ArithmeticMean)
ln = Line(StartPoint=item_4.Item, EndPoint=item_4.Item1)
subtraction_2 = Subtraction(A=avr, B="20")
subtraction_3 = Subtraction(A=multiplication_2, B="20")
divide = DivideCurve(Curve=ln, Count=expr("x-1", tstat.Count), Kinks=False)  # -> graft(Points), Tangents, Parameters
pt_5 = ConstructPoint(XCoordinate=0, YCoordinate=subtraction_2, ZCoordinate=0)
pt_6 = ConstructPoint(XCoordinate=0, YCoordinate=subtraction_3, ZCoordinate=0)
move_6 = Move(Geometry=flatten(divide.Points), Motion=pt_5)  # -> Geometry, Transform
move_7 = Move(Geometry=divide.Points, Motion=pt_6)  # -> Geometry, Transform

# ---- group: Inner Diagram / Text
panel_7 = Panel("""Daily Sea Surface Temperature
[https://pulse.climate.copernicus.eu/]
Annual Average""")
pdecon = Deconstruct(Point=pt)  # -> XComponent, YComponent, ZComponent
panel_8 = Panel("""-10
-18
30""")
pt_7 = ConstructPoint(XCoordinate=pdecon.XComponent, YCoordinate=panel_8, ZCoordinate=0)
panel_9 = Panel("""4
2.5
2""")
tag_2 = TextTag3D(Location=pt_7, Text=panel_7, Size=panel_9, Colour=[swatch_2, swatch_3], Justification=2)

# ---- group: Radial Diagram / Mask
rectangle = Rectangle(Plane=PlaneXY(0, 0, 0), XSize=domain, YSize="0 to 4.0", Radius=0)  # -> Rectangle, Length
disc = Discontinuity(Curve=rectangle.Rectangle, Level=1)  # -> Points, Parameters
conmesh = ConstructMesh(Vertices=disc.Points, Faces={A=0, B=1, C=2, D=3}, Colours=ColourSwatch(SwatchColor=RGBA(255, 255, 255, 249)))
move_8 = Move(Geometry=conmesh, Motion="0,0,1")  # -> Geometry, Transform

# ---- group: Inner Diagram / Lines, Years & Temps
avr_2 = Average(Input=num_5)
move_9 = Move(Geometry=move_6.Geometry, Motion="0,1.5,0")  # -> graft(Geometry), Transform
move_10 = Move(Geometry=divide.Points, Motion="0,-2,0")  # -> Geometry, Transform
expression_2 = Expression(x=avr_2, Expression="Round(x,2)")
xy = XYPlane(Origin=move_10.Geometry)
xy_2 = XYPlane(Origin=move_9.Geometry)
concat_2 = Concatenate(FragmentA="   ", FragmentB=txt_2)
ln_2 = Line(StartPoint=divide.Points, EndPoint=graft(move_6.Geometry))
concat_3 = Concatenate(FragmentA=expression_2, FragmentB="°  ")
prot = RotatePlane(Plane=xy_2, Angle="Pi/2")
prot_2 = RotatePlane(Plane=xy, Angle="Pi/2")
previewlw_2 = CustomPreviewLineweights(Geometry=ln_2, Shader=graft(replace), Thickness="1.5", Absolute=Toggle(True))
tag_3 = TextTag3D(Location=prot_2, Text=concat_2, Size="1.5", Colour=graft(replace), Justification=6)
tag_4 = TextTag3D(Location=prot, Text=concat_3, Size="1.5", Colour=graft(replace), Justification=4)

# ---- group: Inner Diagram / Ref
flip = FlipMatrix(Data=move_7.Geometry)
pline_2 = PolyLine(Vertices=flip, Closed=False)
panel_10 = Panel("""1
1""")
end_2 = EndPoints(Curve=pline_2)  # -> Start, End
dash_2 = DashPattern(Curve=pline_2, Pattern=panel_10)  # -> Dashes, Gaps
num_8 = Number(panel_3)
move_11 = Move(Geometry=end_2.Start, Motion="-1,0,0")  # -> Geometry, Transform
concat_4 = Concatenate(FragmentA=num_8, FragmentB="°  ")
tag_5 = TextTag3D(Location=flatten(move_11.Geometry), Text=concat_4, Size="1", Colour=swatch_3, Justification=6)
preview = CustomPreview(Geometry=dash_2.Dashes, Material=swatch_3)

# ---- group: Radial Diagram / Curves
series_3 = Series(Start="0.12", Step="0.012", Count=tstat.Count)  # -> graft(Series)
previewlw_3 = CustomPreviewLineweights(Geometry=crv, Shader=graft(replace), Thickness=series_3, Absolute=Toggle(True))

# ---- group: Radial Diagram / Reference circles & values
cir = Circle(Plane=pt, Radius=remap.Mapped)
end_3 = EndPoints(Curve=cir)  # -> Start, End
panel_11 = Panel("""1.5
1.5""")
move_12 = Move(Geometry=end_3.Start, Motion="0,2,10")  # -> Geometry, Transform
concat_5 = Concatenate(FragmentC=" ", FragmentA=panel_3, FragmentB="°C")
tag_6 = TextTag3D(Location=move_12.Geometry, Text=concat_5, Size="2", Colour=swatch_2, Justification=4)

# ---- group: Radial Diagram
move_13 = Move(Geometry=cir, Motion=Vector(0, 0, 10))  # -> Geometry, Transform
panel_12 = Panel("2")

# ---- group: Radial Diagram / Today!
expression_3 = Expression(x=tstat.Count, Expression="x-1")
branch = TreeBranch(Tree=crv, Path=expression_3, MaintainPaths=True)
end_4 = EndPoints(Curve=branch)  # -> Start, End
panel_13 = Panel("""   
Today!""")
tag_7 = TextTag3D(Location=end_4.End, Text=panel_13, Size=panel_12, Colour=swatch_2, Justification=5)
dots = DotDisplay(Point=end_4.End, Colour=swatch_2, Size="1.5")

# ---- group: Radial Diagram / Reference circles & values (continued)
dash_3 = DashPattern(Curve=move_13.Geometry, Pattern=panel_11)  # -> Dashes, Gaps
previewlw_4 = CustomPreviewLineweights(Geometry=dash_3.Dashes, Shader=swatch_2, Thickness="0.2", Absolute=Toggle(True))
