# Grasshopper definition Clustering by deviation angle.gh (Grasshopper 1.0.7)
# plug-ins: Anemone, MeshEdit Components, Weaverbird, froGH

mesh = Mesh(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)
f_mc_fpm = MeshConnectivityFaceProximityMap(Mesh=mesh)  # -> ConnectedVertices, ConnectedEdges, simplify(ConnectedFaces)
explode = MeshExplode(Mesh=mesh, Interpolate=False)
faceb = FaceBoundaries(Mesh=mesh)
preview = CustomPreview(Geometry=faceb, Material=ColourSwatch(SwatchColor=RGB(181, 181, 181)))
# Clustering by deviation angle
# Temporary code by Andrea Graziano
# 
# © Co-de-iT 2023 _ Creative Commons Attribution-NonCommercial-ShareAlike 4.0 International License
lng = ListLength(List=explode)
reset = Button()
int = Integer("0")
int_2 = Integer(lng)
# N.B.  this definition uses the following plugins:
# - Anemone by Mateusz Zwierzycki
# - froGH by Co-de-iT
# - WeaverBird by Giulio Piacentino
# D0 >> considered faces
# D1 >> computed faces list
# D2 >> data-tree faces structure
# D3 >> branch number
# D4 >> 0/1 switch
loop_start = LoopStart(N=int_2, T=reset, D0=int, D1=int, D2=int, D3=int, D4=int)  # -> port, Counter, Data, Data_2, Data_3, Data_4, Data_5

index = ItemIndex(List=explode, Item=explode)
difference = SetDifference(SetA=index, SetB=loop_start.Data_2)
item = ListItem(List=difference, Index=0, Wrap=True)

panel = Panel(loop_start.Counter)
branch = TreeBranch(Tree=f_mc_fpm.ConnectedFaces, Path=loop_start.Data, MaintainPaths=True)  # -> flatten(Branch)
weave = Weave(Pattern=loop_start.Data_5, Stream0=item, Stream1=loop_start.Data, NullGaps=False)  # -> flatten(Weave)
branch_2 = TreeBranch(Tree=loop_start.Data_3, Path=loop_start.Data_4, MaintainPaths=True)
sort = SortList(Keys=branch)  # -> Keys, ValuesA
int_3 = Integer(sort.Keys)
item_2 = ListItem(List=explode, Index=weave, Wrap=True)
item_3 = ListItem(List=explode, Index=branch_2, Wrap=True)
dcon = DeleteConsecutive(Set=int_3, Wrap=False)  # -> Set, Count
weave_2 = Weave(Pattern=loop_start.Data_5, Stream0=item_3, Stream1=item_2, NullGaps=False)
difference_2 = SetDifference(SetA=dcon.Set, SetB=loop_start.Data_2)

# ---- group: Angle condition
item_4 = ListItem(List=explode, Index=difference_2, Wrap=True)
facen = FaceNormals(Mesh=item_4)  # -> flatten(Centers), flatten(Normals)
facen_2 = FaceNormals(Mesh=weave_2)  # -> flatten(Centers), flatten(Normals)
vdis = VectorDisplay(Anchor=facen.Centers, Vector=facen.Normals)
vdis_2 = VectorDisplay(Anchor=facen_2.Centers, Vector=facen_2.Normals)
angle = Angle(VectorA=facen_2.Normals, VectorB=graft(facen.Normals))  # -> Angle, Reflex
sort_2 = SortList(Keys=angle.Angle)  # -> reverse(Keys), ValuesA
item_5 = ListItem(List=sort_2.Keys, Index=0, Wrap=True)  # -> flatten(Item)
step_angle = Panel("60")
deg = Degrees(Radians=item_5)
smaller = SmallerThan(FirstNumber=flatten(deg), SecondNumber=step_angle)  # -> SmallerThan, OrEqualTo

# ---- group: Shared edges condition
weave_3 = Weave(Pattern=loop_start.Data_5, Stream0=branch_2, Stream1=weave, NullGaps=False)
merge = Merge(Data1=flatten(weave_3), Data2=flatten(loop_start.Data))
branch_3 = TreeBranch(Tree=f_mc_fpm.ConnectedFaces, Path=graft(difference_2), MaintainPaths=True)
int_4 = Integer(merge)
int_5 = Integer(branch_3)
intersection = SetIntersection(SetA=int_4, SetB=int_5)
lng_2 = ListLength(List=intersection)
larger = LargerThan(FirstNumber=flatten(lng_2), SecondNumber="2")  # -> LargerThan, OrEqualTo

# ----
list = ValueList({"Only deviation angle": 0, "Deviation angle + shared edges": 1}, selected="Deviation angle + shared edges")
or = GateOr(A=smaller.SmallerThan, B=larger.OrEqualTo)
filter = StreamFilter(Gate=list, Stream0=smaller.SmallerThan, Stream1=or)
dispatch = Dispatch(List=difference_2, DispatchPattern=filter)  # -> ListA, ListB

# ---- group: State switch
lng_3 = ListLength(List=dispatch.ListA)
equals = Equality(FirstNumber=lng_3, SecondNumber="0")  # -> Equality, Inequality

# ----
weave_4 = Weave(Pattern=equals.Equality, Stream0=dispatch.ListA, Stream1=item, NullGaps=False)
addition = Addition(A=loop_start.Data_4, B=equals.Equality)
tstat = TreeStatistics(Tree=weave_4)  # -> Paths, Length, Count
merge_2 = Merge(Data1=flatten(loop_start.Data_2), Data2=flatten(weave_4))
replace = ReplacePaths(Data=weave_4, Search=tstat.Paths, Replace=addition)
sort_3 = SortList(Keys=merge_2)  # -> Keys, ValuesA
merge_3 = Merge(Data1=loop_start.Data_3, Data2=replace)
int_6 = Integer(sort_3.Keys)
lng_4 = ListLength(List=explode)
lng_5 = ListLength(List=int_6)
equals_2 = Equality(FirstNumber=lng_4, SecondNumber=lng_5)  # -> Equality, Inequality
int_7 = Integer(equals.Equality)
loop_end = LoopEnd(
    port=loop_start.port,
    Exit=equals_2.Equality,
    Data=weave_4,
    Data_2=int_6,
    Data_3=merge_3,
    Data_4=flatten(addition),
    Data_5=flatten(int_7),
    TimeOutVal=0,
    pausedState=False,
    state="Constant output")  # -> D0, D1, D2, D3, D4
item_6 = ListItem(List=explode, Index=loop_end.D2, Wrap=True)
wbjoin = WeaverbirdsJoinMeshesAndWeld(Mesh=item_6, Weld=Toggle(True))
mesh_2 = Mesh(wbjoin)
medges = MeshEdges(Mesh=mesh_2)  # -> NakedEdges, InteriorEdges, NonManifoldEdges
tstat_2 = TreeStatistics(Tree=mesh_2)  # -> Paths, Length, Count
random = Random(Range="0 to 0.8", Number=tstat_2.Count, Seed="0")
preview_2 = CustomPreview(Geometry=medges.NakedEdges, Material=ColourSwatch(SwatchColor=RGB(69, 69, 69)))
gradient = Gradient(LowerLimit=0, UpperLimit=1, Parameter=random, stops=[0: RGB(255, 255, 255), 1: RGB(18, 80, 114)])
preview_3 = CustomPreview(Geometry=mesh_2, Material=graft(gradient))
