# Grasshopper definition Hatching images.gh (Grasshopper 1.0.7)
# plug-ins: Firefly.X, Weaverbird, Human

# Set the "Hatching images ref_image.jpeg" file
# path or your image file path
path = FilePath()
# Hatching images
# Temporary code by Andrea Graziano
# 
# © Co-de-iT 2023 _ Creative Commons Attribution-NonCommercial-ShareAlike 4.0 International License
number_slider = Slider(1, range=0..10)
load_bitmap = LoadBitmap(FilePathToImageLocation=path)
# N.B.  this definition uses the following plugins:
# - FireFly by Andy Payne
# -WeaverBird by Giulio Piacentino
# - Human by Andrew Heumann
saturation = BrightnessAndSaturation(BitmapToModify=load_bitmap, SaturationMultiplier=1, BrightnessMultiplier=number_slider)

# ---- group: Image2mesh
max_horizontal_resolution_size = Slider(400, range=0..1000)
max_vertical_resolution_size = Slider(300, range=0..1000)

invert = Invert(BitmapToModify=saturation)
info = BitmapInfo(FireflyBitmap=load_bitmap)  # -> PixelResolutionInXAxis, PixelResolutionInYAxis
larger = LargerThan(FirstNumber=info.PixelResolutionInXAxis, SecondNumber=info.PixelResolutionInYAxis)  # -> LargerThan, OrEqualTo
larger_2 = LargerThan(FirstNumber=info.PixelResolutionInXAxis, SecondNumber=info.PixelResolutionInYAxis)  # -> LargerThan, OrEqualTo
expression = Expression(x=max_horizontal_resolution_size, y=info.PixelResolutionInXAxis, z=info.PixelResolutionInYAxis, Expression="(x*z)/y")
expression_2 = Expression(x=max_horizontal_resolution_size, y=info.PixelResolutionInYAxis, z=info.PixelResolutionInXAxis, Expression="(x*z)/y")
expression_3 = Expression(x=max_vertical_resolution_size, y=info.PixelResolutionInXAxis, z=info.PixelResolutionInYAxis, Expression="(x*z)/y")
expression_4 = Expression(x=max_vertical_resolution_size, y=info.PixelResolutionInYAxis, z=info.PixelResolutionInXAxis, Expression="(x*z)/y")
filter = StreamFilter(Gate=larger.LargerThan, Stream0=expression_2, Stream1=max_horizontal_resolution_size)
filter_2 = StreamFilter(Gate=larger.LargerThan, Stream0=max_horizontal_resolution_size, Stream1=expression)
filter_3 = StreamFilter(Gate=larger_2.LargerThan, Stream0=expression_4, Stream1=max_vertical_resolution_size)
filter_4 = StreamFilter(Gate=larger_2.LargerThan, Stream0=max_vertical_resolution_size, Stream1=expression_3)
resize = ResizeBitmap(BitmapToModify=invert, NewResolutionInXAxis=filter, NewResolutionInYAxis=filter_2)
mesh = MeshFromImage(Bmp=resize, Sx=filter_3, Sy=filter_4, Z=1, C=True)

# ----
mesh_2 = Mesh(mesh)

# ---- group: Side mesh (to get close section curves)
wbnaked = WeaverbirdsNakedBoundary(MeshClosedPolylines=mesh_2)
explode = Explode(Curve=wbnaked, Recursive=True)  # -> Segments, Vertices
cull_i = CullIndex(List=explode.Vertices, Indices="0", Wrap=True)
pdecon = Deconstruct(Point=cull_i)  # -> XComponent, YComponent, ZComponent
pt = ConstructPoint(XCoordinate=pdecon.XComponent, YCoordinate=pdecon.YComponent, ZCoordinate="-1")
shift = ShiftList(List=cull_i, Shift=1, Wrap=True)
shift_2 = ShiftList(List=pt, Shift=1, Wrap=True)
merge = Merge(Data1=simplify(graft(cull_i)), Data2=simplify(graft(shift)), Data3=simplify(graft(shift_2)), Data4=simplify(graft(pt)))
conmesh = ConstructMesh(Vertices=merge, Faces={A=0, B=1, C=2, D=3})
wbjoin = WeaverbirdsJoinMeshesAndWeld(Mesh=flatten(conmesh), Weld=False)

# ---- group: Planar sections
bbox = BoundingBox(Content=mesh_2, Plane=PlaneXY(0, 0, 0))  # -> Box, Box_2
n_of_hatches_density = Slider(12, range=0..20)
edges = BrepEdges(Brep=bbox.Box)  # -> Naked, Interior, NonManifold
item = ListItem(List=edges.Interior, Index="8", Wrap=True)
len = Length(Curve=item)
range = Range(Domain=len, Steps=n_of_hatches_density)
pt_2 = ConstructPoint(XCoordinate=0, YCoordinate=0, ZCoordinate=range)
xy = XYPlane(Origin=pt_2)

# ----
wbjoin_2 = WeaverbirdsJoinMeshesAndWeld(Mesh=flatten([mesh_2, wbjoin]), Weld=False)

# ---- group: Layered closed curves extractions
sec = MeshPlane(Mesh=wbjoin_2, Plane=xy)  # -> simplify(Curves)
tstat = TreeStatistics(Tree=sec)  # -> Paths, Length, Count
cull_i_2 = CullIndex(List=tstat.Paths, Indices="0", Wrap=True)
branch = TreeBranch(Tree=sec, Path=cull_i_2, MaintainPaths=False)
join = JoinCurves(Curves=branch, Preserve=False)
cls = Closed(Curve=join)  # -> Closed, Periodic
dispatch = Dispatch(List=join, DispatchPattern=cls.Closed)  # -> ListA, ListB
crv = Curve(dispatch.ListA)

# ----
hatchtable = HatchTable(Update=True)

number_slider_2 = Slider(3, range=0..10)
hatches_selection = Slider(1, range=0..8)
panel = Panel(hatchtable)

# ---- group: Set hatches, scales & rotations
rectangle = Rectangle(Plane=PlaneXY(0, 0, 0), XSize="0 to 10", YSize="0 to 10", Radius=0)  # -> Rectangle, Length
item_2 = ListItem(List=hatchtable, Index=hatches_selection, Wrap=True)
createhatch = CreateHatch(Bake=False, Curves=rectangle.Rectangle, HatchPatternName=item_2, HatchScale=graft(number_slider_2), HatchRotation=0)  # -> HatchGeometry, HatchObjects
end = EndPoints(Curve=createhatch.HatchGeometry)  # -> Start, End
item_3 = ListItem(List=end.Start, Index=0, Wrap=True)
item_4 = ListItem(List=end.Start, Index="1", Wrap=True)
tstat_2 = TreeStatistics(Tree=crv)  # -> Paths, Length, Count
item_5 = ListItem(List=crv, Index=0, Wrap=True)
dist = Distance(PointA=item_3, PointB=item_4)
end_2 = EndPoints(Curve=item_5)  # -> Start, End
lng = ListLength(List=tstat_2.Paths)
expression_5 = Expression(x=dist, Expression="x*(sqrt(2))")
pdecon_2 = Deconstruct(Point=end_2.Start)  # -> XComponent, YComponent, ZComponent
pt_3 = ConstructPoint(XCoordinate=0, YCoordinate=0, ZCoordinate=pdecon_2.ZComponent)
series = Series(Start="-Pi/4", Step="Pi/2", Count=lng)  # -> graft(Series)
range_2 = Range(Domain=expression_5, Steps=expr("x-1", lng))  # -> graft(Range)
createhatch_2 = CreateHatch(Bake=False, Curves=crv, HatchPatternName=item_2, HatchScale=number_slider_2, HatchRotation=series)  # -> HatchGeometry, HatchObjects
vec2pt = Vector2Pt(PointA=pt_3, PointB="0,0,0", Unitize=False)  # -> Vector, Length
X = UnitX(Factor=range_2)
addition = Addition(A=vec2pt.Vector, B=X)
move = Move(Geometry=createhatch_2.HatchGeometry, Motion=addition)  # -> Geometry, Transform

# ----
preview = CustomPreview(Geometry=move.Geometry, Shader=ColourSwatch(SwatchColor=RGB(0, 0, 0)))
