# Grasshopper definition Isocurve on colored mesh.gh (Grasshopper 1.0.7)

# Isocurve on colored mesh
# Temporary code by Andrea Graziano
# 
# © Co-de-iT 2023
number_slider = Slider(0.45, range=0..1)

# ---- group: Isovalue
num = Number(number_slider)

# ---- group: Colored mesh (grayscale)
mesh = Mesh(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)

# ----
preview = CustomPreview(Geometry=mesh, Material=ColourSwatch(SwatchColor=RGB(217, 217, 217)))

# ---- group: Points and values per face
demesh = DeconstructMesh(Mesh=mesh)  # -> Vertices, Faces, Colours, Normals
# N.B.  this definition uses the following plugins:
# -
deface = DeconstructFace(Face=demesh.Faces)  # -> CornerA, CornerB, CornerC, CornerD
argb = SplitARGB(Colour=demesh.Colours)  # -> Alpha, Red, Green, Blue
merge = Merge(Data1=graft(deface.CornerA), Data2=graft(deface.CornerB), Data3=graft(deface.CornerC), Data4=graft(deface.CornerD))  # -> simplify(Result)
item = ListItem(List=argb.Red, Index=merge, Wrap=True)
item_2 = ListItem(List=demesh.Vertices, Index=merge, Wrap=True)

# ---- group: Dispatching void faces
smaller = SmallerThan(FirstNumber=num, SecondNumber=item)  # -> SmallerThan, OrEqualTo
ma = MassAddition(Input=smaller.SmallerThan)  # -> Result, PartialResults
lng = ListLength(List=smaller.SmallerThan)
expression = Expression(x=ma.Result, y=lng, Expression="if((x=0)or(x=y),false,true)")
toggle = BooleanToggle(True)
toggle_2 = BooleanToggle(True)
dispatch = Dispatch(List=item, DispatchPattern=expression)  # -> ListA, ListB
dispatch_2 = Dispatch(List=item_2, DispatchPattern=expression)  # -> ListA, ListB
clean = CleanTree(RemoveNulls=toggle_2, RemoveInvalid=toggle_2, RemoveEmpty=toggle_2, Tree=dispatch.ListA)
clean_2 = CleanTree(RemoveNulls=toggle, RemoveInvalid=toggle, RemoveEmpty=toggle, Tree=dispatch_2.ListA)

# ----
shift = ShiftList(List=clean_2, Shift=1, Wrap=True)
shift_2 = ShiftList(List=clean, Shift=1, Wrap=True)
graft = GraftTree(Tree=clean_2, IncludeEmptyLists=True, IncludeNullItems=True)  # -> simplify(Tree)
graft_2 = GraftTree(Tree=shift, IncludeEmptyLists=True, IncludeNullItems=True)  # -> simplify(Tree)
graft_3 = GraftTree(Tree=clean, IncludeEmptyLists=True, IncludeNullItems=True)  # -> simplify(Tree)
graft_4 = GraftTree(Tree=shift_2, IncludeEmptyLists=True, IncludeNullItems=True)  # -> simplify(Tree)
dom = ConstructDomain(DomainStart=graft_3, DomainEnd=graft_4)
inc = Includes(Value=num, Domain=dom)  # -> Includes, Deviation
dispatch_3 = Dispatch(List=graft, DispatchPattern=inc.Includes)  # -> ListA, ListB
dispatch_4 = Dispatch(List=graft_2, DispatchPattern=inc.Includes)  # -> ListA, ListB
dispatch_5 = Dispatch(List=graft_4, DispatchPattern=inc.Includes)  # -> ListA, ListB
dispatch_6 = Dispatch(List=graft_3, DispatchPattern=inc.Includes)  # -> ListA, ListB
toggle_3 = BooleanToggle(True)
toggle_4 = BooleanToggle(True)
toggle_5 = BooleanToggle(True)
toggle_6 = BooleanToggle(True)
clean_3 = CleanTree(RemoveNulls=toggle_6, RemoveInvalid=toggle_6, RemoveEmpty=toggle_6, Tree=dispatch_3.ListA)
clean_4 = CleanTree(RemoveNulls=toggle_3, RemoveInvalid=toggle_3, RemoveEmpty=toggle_3, Tree=dispatch_4.ListA)
clean_5 = CleanTree(RemoveNulls=toggle_4, RemoveInvalid=toggle_4, RemoveEmpty=toggle_4, Tree=dispatch_5.ListA)
clean_6 = CleanTree(RemoveNulls=toggle_5, RemoveInvalid=toggle_5, RemoveEmpty=toggle_5, Tree=dispatch_6.ListA)

# ---- group: Iso-points
# P = P1 + (isovalue - V1) (P2 - P1) / (V2 - V1)
expression_2 = Expression(x=clean_3, y=clean_4, z=clean_6, u=clean_5, v=num, Expression="x+((v-z)*(y-x))/(u-z)")

# ----
pt = Point(expression_2)
pshift = ShiftPaths(Data=pt, Offset=-1)
cullpt = CullDuplicates(Points=pshift, Tolerance="0.0001", CullMode=1)  # -> Points, Indices, Valence
item_3 = ListItem(List=cullpt.Points, Index=0, Wrap=True)  # -> Item, Item1
ln = Line(StartPoint=item_3.Item, EndPoint=item_3.Item1)
join = JoinCurves(Curves=flatten(ln), Preserve=False)
preview_2 = CustomPreview(Geometry=join, Material=ColourSwatch(SwatchColor=RGB(255, 0, 0)))
