# Grasshopper definition K-means points clustering.gh (Grasshopper 1.0.7)
# plug-ins: Anemone

# ---- group: Points to be clusterized
# K-means points clustering
# Temporary code by Andrea Graziano
# 
# © Co-de-iT 2023
# https://en.wikipedia.org/wiki/K-means_clustering
box = DomainBox(Base=PlaneXY(0, 0, 0), X="0 to 100", Y="0 to 100", Z="0 to 100")
pop3d = Populate3D(Region=box, Count="500", Seed=1)
pt = Point(pop3d)

# ---- group: initial K-mean set
k_clusters_n = Slider(7, range=2..12)
pop3d_2 = Populate3D(Region=box, Count=k_clusters_n, Seed=1)
pt_2 = Point(pop3d_2)

# ----
# N.B.  this definition uses the following plugins:
# - Anemone by Mateusz Zwierzycki
loop_start = LoopStart(N="100", T=Button(), D0=pt, D1=pt_2)  # -> port, Counter, Data, Data_2
iterations = Panel(loop_start.Counter)
cp = ClosestPoint(Point=loop_start.Data, Cloud=loop_start.Data_2)  # -> ClosestPoint, CPIndex, Distance
cset = CreateSet(List=cp.CPIndex)  # -> Set, Map
mindex = MemberIndex(Set=cp.CPIndex, Member=cset.Set)  # -> Index, Count
item = ListItem(List=loop_start.Data, Index=mindex.Index, Wrap=True)
avr = Average(Input=item)  # -> flatten(ArithmeticMean)

# ---- group: Exit loop condition
dist = Distance(PointA=loop_start.Data_2, PointB=avr)
ma = MassAddition(Input=dist)  # -> Result, PartialResults
smaller = SmallerThan(FirstNumber=ma.Result, SecondNumber="0.01")  # -> SmallerThan, OrEqualTo

# ----
panel = Panel(ma.Result)
loop_end = LoopEnd(
    port=loop_start.port,
    Exit=smaller.OrEqualTo,
    Data=loop_start.Data,
    Data_2=avr,
    TimeOutVal=0,
    pausedState=False,
    state="Constant output")  # -> D0, D1
pt_3 = Point(loop_end.D0)

pt_4 = Point(loop_end.D1)

cp_2 = ClosestPoint(Point=pt_3, Cloud=pt_4)  # -> ClosestPoint, CPIndex, Distance
cset_2 = CreateSet(List=cp_2.CPIndex)  # -> Set, Map
gradient = Gradient(
    LowerLimit=0,
    UpperLimit=k_clusters_n,
    Parameter=graft(cset_2.Set),
    stops=[0: RGB(243, 57, 0), 0.1: RGB(236, 27, 60), 0.2: RGB(210, 0, 118), 0.3: RGB(103, 0, 120), 0.4: RGB(39, 72, 161), 0.5: RGB(1, 192, 229), 0.6: RGB(18, 178, 90), 0.7: RGB(79, 186, 8), 0.8: RGB(220, 237, 32), 0.9: RGB(247, 159, 20), 1: RGB(243, 57, 0)])
mindex_2 = MemberIndex(Set=cp_2.CPIndex, Member=cset_2.Set)  # -> Index, Count
voronoi³ = Voronoi3D(Points=pt_4, Box=box)  # -> graft(Cells), Boundary
item_2 = ListItem(List=pt_3, Index=mindex_2.Index, Wrap=True)
edges = BrepEdges(Brep=voronoi³.Cells)  # -> Naked, Interior, NonManifold
ln = Line(StartPoint=item_2, EndPoint=graft(pt_4))
preview = CustomPreview(Geometry=edges.Interior, Material=gradient)
preview_2 = CustomPreview(Geometry=ln, Material=gradient)
cloud = CloudDisplay(Points=item_2, Colours=gradient, Size=1, SpriteType=0)
