# Grasshopper definition Marching cubes algorithm.gh (Grasshopper 1.0.7)
# plug-ins: Noise 4D, MeshEdit Components

isovalue = Slider(-0.01, range=-1..1)
# Marching cubes algorithm - vanilla edition
# Temporary code by Andrea Graziano
# 
# © Co-de-iT 2023
panel = Panel("0,0,0")
y_res = Slider(12, range=0..100)
z_res = Slider(12, range=0..100)
x_res = Slider(12, range=0..100)
box = Box2Pt(PointA=panel, PointB="20,20,20", Plane=PlaneXY(0, 0, 0))
debox = DeconstructBox(Box=box)  # -> Plane, X, Y, Z
range = Range(Domain=debox.Y, Steps=expr("x-1", y_res))
range_2 = Range(Domain=debox.Z, Steps=expr("x-1", z_res))
range_3 = Range(Domain=debox.X, Steps=expr("x-1", x_res))
crossref = CrossReference(ListA=range_3, ListB=range, ListC=range_2, CrossMode=1)  # -> ListA, ListB, ListC
# N.B.  this definition uses the following plugins:
# - WeaverBird by Giulio Piacentino
# - MeshEdit2000 by [uto]
pt = ConstructPoint(XCoordinate=crossref.ListA, YCoordinate=crossref.ListB, ZCoordinate=crossref.ListC)
simplex = SimplexNoise(Values=pt, Time=Slider(3, range=0..10), Scale=Slider(0.04, range=0..1))

box_2 = Box(box)

# ---- group: Values
num = Number(simplex)

# ---- group: Y res
int = Integer(y_res)

# ---- group: Isovalue
# Isosurface
# inputs
num_2 = Number(isovalue)

# ---- group: X res
int_2 = Integer(x_res)

# ---- group: Z res
int_3 = Integer(z_res)

# ---- group: Sample points grid
debox_2 = DeconstructBox(Box=box_2)  # -> Plane, X, Y, Z
range_4 = Range(Domain=debox_2.Y, Steps=expr("x-1", int))
range_5 = Range(Domain=debox_2.Z, Steps=expr("x-1", int_3))
range_6 = Range(Domain=debox_2.X, Steps=expr("x-1", int_2))
crossref_2 = CrossReference(ListA=range_6, ListB=range_4, ListC=range_5, CrossMode=1)  # -> ListA, ListB, ListC
pt_2 = ConstructPoint(XCoordinate=crossref_2.ListA, YCoordinate=crossref_2.ListB, ZCoordinate=crossref_2.ListC)

# ---- group: Data structure
multiplication = Multiplication(A=int_2, B=int)
partition = PartitionList(List=num, Size=multiplication)  # -> simplify(Chunks)
partition_2 = PartitionList(List=pt_2, Size=multiplication)  # -> simplify(Chunks)
partition_3 = PartitionList(List=partition_2, Size=int_2)  # -> simplify(Chunks)
partition_4 = PartitionList(List=partition, Size=int_2)  # -> simplify(Chunks)

# ----
relitem = RelativeItem(Tree=partition_4, Offset="{-1;-1}(-1)", WrapPaths=False, WrapItems=False)  # -> ItemA, flatten(ItemB)
relitem_2 = RelativeItem(Tree=partition_4, Offset="{-1;-1}(+1)", WrapPaths=False, WrapItems=False)  # -> ItemA, flatten(ItemB)
relitem_3 = RelativeItem(Tree=partition_4, Offset="{-1;+1}(+1)", WrapPaths=False, WrapItems=False)  # -> ItemA, flatten(ItemB)
relitem_4 = RelativeItem(Tree=partition_4, Offset="{-1;+1}(-1)", WrapPaths=False, WrapItems=False)  # -> ItemA, flatten(ItemB)
relitem_5 = RelativeItem(Tree=partition_4, Offset="{+1;-1}(-1)", WrapPaths=False, WrapItems=False)  # -> ItemA, flatten(ItemB)
relitem_6 = RelativeItem(Tree=partition_4, Offset="{+1;-1}(+1)", WrapPaths=False, WrapItems=False)  # -> ItemA, flatten(ItemB)
relitem_7 = RelativeItem(Tree=partition_4, Offset="{+1;+1}(+1)", WrapPaths=False, WrapItems=False)  # -> ItemA, flatten(ItemB)
relitem_8 = RelativeItem(Tree=partition_4, Offset="{+1;+1}(-1)", WrapPaths=False, WrapItems=False)  # -> ItemA, flatten(ItemB)
merge = Merge(
    Data1=graft(relitem.ItemB),
    Data2=graft(relitem_2.ItemB),
    Data3=graft(relitem_3.ItemB),
    Data4=graft(relitem_4.ItemB),
    Data5=graft(relitem_5.ItemB),
    Data6=graft(relitem_6.ItemB),
    Data7=graft(relitem_7.ItemB),
    Data8=graft(relitem_8.ItemB))  # -> simplify(Result)
relitem_9 = RelativeItem(Tree=partition_3, Offset="{-1;-1}(-1)", WrapPaths=False, WrapItems=False)  # -> ItemA, flatten(ItemB)
relitem_10 = RelativeItem(Tree=partition_3, Offset="{-1;-1}(+1)", WrapPaths=False, WrapItems=False)  # -> ItemA, flatten(ItemB)
relitem_11 = RelativeItem(Tree=partition_3, Offset="{-1;+1}(+1)", WrapPaths=False, WrapItems=False)  # -> ItemA, flatten(ItemB)
relitem_12 = RelativeItem(Tree=partition_3, Offset="{-1;+1}(-1)", WrapPaths=False, WrapItems=False)  # -> ItemA, flatten(ItemB)
relitem_13 = RelativeItem(Tree=partition_3, Offset="{+1;-1}(-1)", WrapPaths=False, WrapItems=False)  # -> ItemA, flatten(ItemB)
relitem_14 = RelativeItem(Tree=partition_3, Offset="{+1;-1}(+1)", WrapPaths=False, WrapItems=False)  # -> ItemA, flatten(ItemB)
relitem_15 = RelativeItem(Tree=partition_3, Offset="{+1;+1}(+1)", WrapPaths=False, WrapItems=False)  # -> ItemA, flatten(ItemB)
relitem_16 = RelativeItem(Tree=partition_3, Offset="{+1;+1}(-1)", WrapPaths=False, WrapItems=False)  # -> ItemA, flatten(ItemB)
merge_2 = Merge(
    Data1=graft(relitem_9.ItemB),
    Data2=graft(relitem_10.ItemB),
    Data3=graft(relitem_11.ItemB),
    Data4=graft(relitem_12.ItemB),
    Data5=graft(relitem_13.ItemB),
    Data6=graft(relitem_14.ItemB),
    Data7=graft(relitem_15.ItemB),
    Data8=graft(relitem_16.ItemB))  # -> simplify(Result)
smaller = SmallerThan(FirstNumber=num_2, SecondNumber=merge)  # -> SmallerThan, OrEqualTo
ma = MassAddition(Input=smaller.SmallerThan)  # -> Result, PartialResults
expression = Expression(x=ma.Result, Expression="if((x=0)or(x=8),false,true)")
tritable_256_16 = Panel("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")
toggle = BooleanToggle(True)
dispatch = Dispatch(List=merge, DispatchPattern=expression)  # -> ListA, ListB
toggle_2 = BooleanToggle(True)
toggle_3 = BooleanToggle(True)
toggle_4 = BooleanToggle(True)
toggle_5 = BooleanToggle(True)
rep = ReplaceText(Text=tritable_256_16, Find="],[", Replace=";", RecursiveReplace=False)
dispatch_2 = Dispatch(List=merge, DispatchPattern=expression)  # -> ListA, ListB
dispatch_3 = Dispatch(List=merge, DispatchPattern=expression)  # -> ListA, ListB
dispatch_4 = Dispatch(List=merge_2, DispatchPattern=expression)  # -> ListA, ListB
dispatch_5 = Dispatch(List=merge_2, DispatchPattern=expression)  # -> ListA, ListB
clean = CleanTree(RemoveNulls=toggle, RemoveInvalid=toggle, RemoveEmpty=toggle, Tree=dispatch.ListA)
clean_2 = CleanTree(RemoveNulls=toggle_2, RemoveInvalid=toggle_2, RemoveEmpty=toggle_2, Tree=dispatch_3.ListA)
clean_3 = CleanTree(RemoveNulls=toggle_3, RemoveInvalid=toggle_3, RemoveEmpty=toggle_3, Tree=dispatch_5.ListA)
clean_4 = CleanTree(RemoveNulls=toggle_5, RemoveInvalid=toggle_5, RemoveEmpty=toggle_5, Tree=dispatch_4.ListA)
clean_5 = CleanTree(RemoveNulls=toggle_4, RemoveInvalid=toggle_4, RemoveEmpty=toggle_4, Tree=dispatch_2.ListA)
rep_2 = ReplaceText(Text=rep, Find="[", Replace="-1", RecursiveReplace=False)
smaller_2 = SmallerThan(FirstNumber=clean, SecondNumber=num_2)  # -> SmallerThan, OrEqualTo
split = TextSplit(Text=rep_2, Separators=";")
panel_2 = Panel("""0
1
2
3
4
5
6
7
0
1
2
3""")
panel_3 = Panel("""1
2
3
0
5
6
7
4
4
5
6
7""")
panel_4 = Panel("""1
2
4
8
16
32
64
128""")
int_4 = Integer(smaller_2.SmallerThan)
split_2 = TextSplit(Text=split, Separators=";")
item = ListItem(List=clean_5, Index=panel_2, Wrap=True)
item_2 = ListItem(List=clean_2, Index=panel_3, Wrap=True)
item_3 = ListItem(List=clean_4, Index=panel_2, Wrap=True)
item_4 = ListItem(List=clean_3, Index=panel_3, Wrap=True)
multiplication_2 = Multiplication(A=int_4, B=panel_4)
rep_3 = ReplaceText(Text=split_2, Find=" ", RecursiveReplace=False)  # -> flatten(Result)
ma_2 = MassAddition(Input=multiplication_2)  # -> Result, PartialResults
dom = ConstructDomain(DomainStart=item, DomainEnd=item_2)
item_5 = ListItem(List=rep_3, Index=ma_2.Result, Wrap=True)
inc = Includes(Value=num_2, Domain=dom)  # -> Includes, Deviation
split_3 = TextSplit(Text=item_5, Separators=",")
dispatch_6 = Dispatch(List=item_3, DispatchPattern=inc.Includes)  # -> ListA, ListB
dispatch_7 = Dispatch(List=item_4, DispatchPattern=inc.Includes)  # -> ListA, ListB
dispatch_8 = Dispatch(List=item, DispatchPattern=inc.Includes)  # -> ListA, ListB
dispatch_9 = Dispatch(List=item_2, DispatchPattern=inc.Includes)  # -> ListA, ListB
partition_5 = PartitionList(List=split_3, Size="3")
int_5 = Integer(inc.Includes)
expression_2 = Expression(
    x=dispatch_6.ListA,
    y=dispatch_7.ListA,
    z=dispatch_8.ListA,
    u=dispatch_9.ListA,
    v=num_2,
    Expression="x+((v-z)*(y-x))/(u-z)")
join = TextJoin(Text=partition_5, Join=";")
multiplication_3 = Multiplication(A=int_5, B="0")
concat = Concatenate(FragmentA="T{", FragmentB=join, FragmentC="}")
pt_3 = ConstructPoint(XCoordinate=multiplication_3, YCoordinate=multiplication_3, ZCoordinate=multiplication_3)
pshift = ShiftPaths(Data=concat, Offset=-1)
weave = Weave(Pattern=inc.Includes, Stream0=pt_3, Stream1=expression_2, NullGaps=False)
conmesh = ConstructMesh(Vertices=weave, Faces=pshift)
mjoin = MeshJoin(Meshes=flatten(conmesh))
weldvertices = MeshWeldVertices(Mesh=mjoin, Tolerance=0.01)  # -> RuntimeMessage, Mesh

# ----
# Reference:
# https://paulbourke.net/geometry/polygonise/
image = ImageSampler(
    FilePath="D:\Documenti\CODEIT\Test GH\Marching Cubes\EdgeIndex_VertexIndex.png",
    Filter="Colour",
    Interpolate=False,
    Umax=1,
    Umin=0,
    Vmax=1,
    Vmin=0,
    Wrap=1)

mesh = Mesh(weldvertices.Mesh)
mcol = MeshColours(Mesh=mesh, Colours=ColourSwatch(SwatchColor=RGB(97, 97, 97)))
preview = CustomPreview(Geometry=mcol, Material=ColourSwatch(SwatchColor=RGB(171, 171, 171)))
