# Grasshopper definition Meandering.gh (Grasshopper 1.0.7)
# plug-ins: Anemone

# Meandering
# Temporary code by Andrea Graziano
# 
# © Co-de-iT 2023 _ Creative Commons Attribution-NonCommercial-ShareAlike 4.0 International License
# Reference
# http://roberthodgin.com/project/meander
number_slider = Slider(99, range=0..99)
crv = Curve(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)
loop_start = LoopStart(N=number_slider, T=Button(), D0=crv, D1=crv)  # -> port, Counter, simplify(Data), simplify(Data_2)
# N.B.  this definition uses the following plugins:
# - Anemone by Mateusz Zwierzycki
panel = Panel(loop_start.Counter)
range = Range(Domain=Domain(0, 1), Steps=Slider(500, range=0..1000))
eval = EvaluateCurve(Curve=reparameterize(graft(loop_start.Data)), Parameter=range)  # -> Point, Tangent, Angle
curvature = Curvature(Curve=reparameterize(graft(loop_start.Data)), Parameter=range)  # -> P, K, C
vlen = VectorLength(Vector=curvature.K)
multiplication = Multiplication(A=vlen, B=Slider(0.02, range=0..0.2))
amp = Amplitude(Vector=curvature.K, Amplitude=multiplication)
rev = Reverse(Vector=amp)
amp_2 = Amplitude(Vector=eval.Tangent, Amplitude=Slider(0.02, range=0..0.2))
addition = Addition(A=rev, B=amp_2)
move = Move(Geometry=curvature.P, Motion=addition)  # -> Geometry, Transform
intcrv = Interpolate(Vertices=move.Geometry, Degree=3, Periodic=False, KnotStyle=1)  # -> flatten(Curve), Length, Domain
reb = RebuildCurve(Curve=intcrv.Curve, Degree="3", Count=Slider(30, range=0..100), Tangents=Toggle(False))  # -> flatten(Curve)
merge = Merge(Data1=flatten(loop_start.Data_2), Data2=flatten(reb))
lng = ListLength(List=crv)
multiplication_2 = Multiplication(A=lng, B=number_slider)
loop_end = LoopEnd(
    port=loop_start.port,
    Exit=False,
    Data=simplify(reb),
    Data_2=simplify(merge),
    TimeOutVal=0,
    pausedState=False,
    state="Constant output")  # -> D0, D1
range_2 = Range(Domain=Domain(0, 1), Steps=multiplication_2)
gradient = Gradient(LowerLimit=0, UpperLimit=1, Parameter=range_2, stops=[0: RGB(255, 255, 255), 1: RGB(0, 0, 0)])
preview = CustomPreview(Geometry=loop_end.D0, Material=ColourSwatch(SwatchColor=RGB(0, 112, 255)))
preview_2 = CustomPreview(Geometry=loop_end.D1, Material=gradient)
