# Grasshopper definition Mesh from lines.gh (Grasshopper 1.0.7)
# plug-ins: froGH, Bowerbird2, Shortest Walk in Gh, Kangaroo2 Components, Human, MeshEdit Components, Weaverbird

# Mesh from lines
# Temporary code by Andrea Graziano
# 
# © Co-de-iT 2023 _ Creative Commons Attribution-NonCommercial-ShareAlike 4.0 International License
crv = Curve([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])

# ---- group: Ordered half edges
explode = Explode(Curve=crv, Recursive=True)  # -> flatten(Segments), Vertices
number_slider = Slider(0.3, range=0..1)
crv_2 = Curve(explode.Segments)
f_tln = Topologizer(LinesNetwork=flatten(crv_2), Decimals=3)  # -> Points, LinePointsData, Point2PointsConnectivity, LineDirectionAtEachPoint
bboffset = BBOffset(Curves=graft(crv_2), Distance=number_slider, EndType="0", JoinType=0, MiterLimit=10, ArcTolerance=0.01)
runion = RegionUnion(Curves=flatten(bboffset))
lng = ListLength(List=f_tln.Point2PointsConnectivity)
equals = Equality(FirstNumber=lng, SecondNumber="1")  # -> Equality, Inequality
area = Area(Geometry=runion)  # -> Area, Centroid
dispatch = Dispatch(List=f_tln.Points, DispatchPattern=flatten(equals.Equality))  # -> ListA, ListB
sort = SortList(Keys=area.Area, ValuesA=runion)  # -> reverse(Keys), reverse(ValuesA)
item = ListItem(List=sort.ValuesA, Index="0", Wrap=True)
cull_i = CullIndex(List=sort.ValuesA, Indices="0", Wrap=True)
alongcrv = SortAlongCurve(Points=dispatch.ListA, Curve=item)  # -> Points, Indices
shift = ShiftList(List=alongcrv.Points, Shift=1, Wrap=True)
offset = OffsetCurve(Curve=cull_i, Distance=number_slider, Corners=1)
ln = Line(StartPoint=graft(alongcrv.Points), EndPoint=graft(shift))  # -> simplify(Line)
shortwalk = ShortestWalk(Curves=flatten(crv_2), WantedPath=ln)  # -> simplify(ShortestWalk), Succession, Direction, Length
merge = Merge(Data1=flatten(shortwalk.ShortestWalk), Data2=flatten(offset))  # -> simplify(graft(Result))

# ----
# N.B.  this definition uses the following plugins:
# - froGH by Co-de-iT
# - Bowerbird by Thomas Oberbichler
# - ShortestWalk by Giulio Piacentino
# - Weaverbird by Giulio Piacentino
# - Human by andrew Heumann
# - MeshEdit2000 by uto
previewlw = CustomPreviewLineweights(
    Geometry=crv_2,
    Shader=ColourSwatch(SwatchColor=RGB(255, 0, 0)),
    Thickness=Slider(0.35, range=0..1),
    Absolute=Toggle(True))

move = Move(Geometry=dispatch.ListA, Motion="0,0,1")  # -> Geometry, Transform
points = PointList(Points=move.Geometry, Size=Slider(2, range=0..10))

crv_3 = Curve(merge)
flip = FlipCurve(Curve=crv_3)  # -> Curve, Flag

# ---- group: Island detection
cls = Closed(Curve=crv_3)  # -> Closed, Periodic
bool = Boolean(cls.Closed)

# ----
disc = Discontinuity(Curve=crv_3, Level=1)  # -> Points, Parameters
disc_2 = Discontinuity(Curve=flip.Curve, Level=1)  # -> Points, Parameters

dispatch_2 = Dispatch(List=disc_2.Parameters, DispatchPattern=bool)  # -> ListA, ListB
shift_2 = ShiftList(List=dispatch_2.ListA, Shift=1, Wrap=True)
weave = Weave(Pattern=bool, Stream0=dispatch_2.ListB, Stream1=shift_2, NullGaps=False)

eval = EvaluateCurve(Curve=flip.Curve, Parameter=reverse(weave))  # -> Point, Tangent, Angle
eval_2 = EvaluateCurve(Curve=crv_3, Parameter=disc.Parameters)  # -> Point, Tangent, Angle
xprod = CrossProduct(VectorA=eval_2.Tangent, VectorB=eval.Tangent, Unitize=False)  # -> Vector, Length
dprod = DotProduct(VectorA=eval_2.Tangent, VectorB=eval.Tangent, Unitize=False)
expression = Expression(x=xprod.Length, y=dprod, Expression="atan2(x,y)")
devec = DeconstructVector(Vector=xprod.Vector)  # -> XComponent, YComponent, ZComponent
smaller = SmallerThan(FirstNumber=devec.ZComponent, SecondNumber="0")  # -> SmallerThan, OrEqualTo
deg = Degrees(Radians=expression)
expression_2 = Expression(x=deg, Expression="360-x")
weave_2 = Weave(
    Pattern=simplify(graft(smaller.SmallerThan)),
    Stream0=simplify(graft(expression_2)),
    Stream1=simplify(graft(deg)),
    NullGaps=False)

kg_relaxation = BooleanToggle(True)
stripes_direction = BooleanToggle(False)
# Parameters
offset_2 = Slider(5, range=0..5)
anchor_scale = Slider(0.25, range=0.2..1)
mesh_resolution = Slider(1, range=1..2)
division = Division(A=offset_2, B=mesh_resolution)

path_mapper = PathMapper(weave_2, source=["{A}", "{A;B}"], target=["{0}", "{A}"])

# ---- group: Bisect vectors
Z = UnitZ(Factor=1)
vrot = Rotate(Vector=eval.Tangent, Axis=Z, Angle=expr("x/2", degrees(path_mapper)))

# ---- group: Defining lenght
rad = Radians(Degrees=path_mapper)
expression_3 = Expression(x=graft(offset_2), y=rad, Expression="x/(sin(y/2))")  # -> simplify(R)

# ----
vdisex = VectorDisplayEx(Point=eval.Point, Vector=vrot, Colour=ColourSwatch(SwatchColor=RGB(0, 104, 201)), Width="4")

tstat = TreeStatistics(Tree=expression_3)  # -> Paths, Length, Count
bool_2 = Boolean(bool)
dispatch_3 = Dispatch(List=tstat.Paths, DispatchPattern=flatten(bool_2))  # -> ListA, ListB
branch = TreeBranch(Tree=expression_3, Path=dispatch_3.ListA, MaintainPaths=True)
branch_2 = TreeBranch(Tree=expression_3, Path=dispatch_3.ListB, MaintainPaths=True)
item_2 = ListItem(List=branch_2, Index="0", Wrap=True)
multiplication = Multiplication(A=item_2, B=anchor_scale)
replace = ReplaceItems(List=branch_2, Item=multiplication, Indices="0", Wrap=False)
lng_2 = ListLength(List=replace)
replace_2 = ReplaceItems(List=replace, Item=multiplication, Indices=expr("x-1", lng_2), Wrap=False)  # -> simplify(List)
merge_2 = Merge(Data1=branch, Data2=replace_2)

line = LineSDL(Start=simplify(disc.Points), Direction=simplify(vrot), Length=simplify(merge_2))  # -> simplify(Line)

bool_3 = Boolean(bool)
dispatch_4 = Dispatch(List=line, DispatchPattern=bool_3)  # -> ListA, ListB
item_3 = ListItem(List=dispatch_4.ListA, Index=0, Wrap=True)
merge_3 = Merge(Data1=dispatch_4.ListA, Data2=item_3)
weave_3 = Weave(Pattern=bool_3, Stream0=dispatch_4.ListB, Stream1=merge_3, NullGaps=False)

int = Integer(expr("x+1", simplify(division)))

# ---- group: Mesh from lines
crv_4 = Curve(weave_3)
toggle = BooleanToggle(False)
explode_2 = Explode(Curve=crv_3, Recursive=True)  # -> Segments, Vertices
len = Length(Curve=explode_2.Segments)
shift_3 = ShiftList(List=crv_4, Shift="-1", Wrap=toggle)
shift_4 = ShiftList(List=crv_4, Shift="+1", Wrap=toggle)
end = EndPoints(Curve=shift_4)  # -> Start, End
end_2 = EndPoints(Curve=shift_3)  # -> Start, End
division_2 = Division(A=len, B=mesh_resolution)
merge_4 = Merge(Data1=graft(end_2.Start), Data2=graft(end_2.End), Data3=graft(end.End), Data4=graft(end.Start))
lng_3 = ListLength(List=division_2)
dup = DuplicateData(Data=int, Number=lng_3, Order=True)  # -> simplify(graft(Data))
conmesh = ConstructMesh(Vertices=merge_4, Faces={A=0, B=1, C=2, D=3})  # -> simplify(Mesh)
int_2 = Integer(graft(division_2))
f_submqf = MeshSubdivideQuadFaces(Mesh=conmesh, USubdivisions=int_2, VSubdivisions=dup)  # -> simplify(Mesh)

# ----
mjoin = MeshJoin(Meshes=flatten(f_submqf))

pshift = ShiftPaths(Data=f_submqf, Offset=-1)
wbjoin = WeaverbirdsJoinMeshesAndWeld(Mesh=pshift, Weld=False)
lng_4 = ListLength(List=flatten(wbjoin))
range = Range(Domain=Domain(0, 1), Steps=expr("x-1", lng_4))
gradient = Gradient(
    LowerLimit=0,
    UpperLimit=1,
    Parameter=range,
    stops=[0: RGB(243, 57, 0), 0.1: RGB(236, 27, 60), 0.2: RGB(210, 0, 118), 0.3: RGB(103, 0, 120), 0.4: RGB(39, 72, 161), 0.5: RGB(1, 192, 229), 0.6: RGB(18, 178, 90), 0.7: RGB(79, 186, 8), 0.8: RGB(220, 237, 32), 0.9: RGB(247, 159, 20), 1: RGB(128, 128, 128)])
mcol = MeshColours(Mesh=wbjoin, Colours=simplify(graft(gradient)))
preview = CustomPreview(Geometry=mcol, Shader=ColourSwatch(SwatchColor=RGB(255, 255, 255)))

weldvertices = MeshWeldVertices(Mesh=mjoin, Tolerance=0.01)  # -> RuntimeMessage, Mesh

filter = StreamFilter(Gate=kg_relaxation, Stream1=weldvertices.Mesh)
filter_2 = StreamFilter(Gate=kg_relaxation, Stream1=crv_4)

bool_4 = Boolean(bool)
dispatch_5 = Dispatch(List=filter_2, DispatchPattern=bool_4)  # -> ListA, ListB
lng_5 = ListLength(List=dispatch_5.ListB)  # -> expr("x-1", Length)
item_4 = ListItem(List=dispatch_5.ListB, Index=0, Wrap=True)
item_5 = ListItem(List=dispatch_5.ListB, Index=lng_5, Wrap=True)
merge_5 = Merge(Data1=item_4, Data2=item_5)  # -> flatten(Result)
join = JoinCurves(Curves=merge_5, Preserve=False)

# ---- group: Getting anchor points
nakededge = MeshNakedEdge(Mesh=filter)  # -> V, A, B
item_6 = ListItem(List=nakededge.V, Index=nakededge.A, Wrap=True)
crv_cp = CurveClosestPoint(Point=graft(item_6), Curve=flatten(join))  # -> Point, Parameter, Distance
sort_2 = SortList(Keys=crv_cp.Distance)  # -> Keys, ValuesA
item_7 = ListItem(List=sort_2.Keys, Index=0, Wrap=True)
smaller_2 = SmallerThan(FirstNumber=item_7, SecondNumber="0.001")  # -> SmallerThan, OrEqualTo
dispatch_6 = Dispatch(List=graft(item_6), DispatchPattern=smaller_2.SmallerThan)  # -> ListA, ListB

# ---- group: Kangaroo relaxation
pt = Point(flatten(dispatch_6.ListA))
mesh = Mesh(filter)
anchor = Anchor(Point=pt, Strength=10000)
show = Show(G=mesh)

warpweft = WarpWeft(Mesh=mesh)  # -> Warp, Weft, NakedA, NakedB
len_2 = Length(Curve=warpweft.Warp)
len_3 = Length(Curve=warpweft.Weft)
multiplication_2 = Multiplication(A=len_2, B=Slider(1, range=0..2))
multiplication_3 = Multiplication(A=len_3, B=Slider(0.4, range=0..2))
length_line = LengthLine(Line=warpweft.Weft, Length=multiplication_3, Strength=10)
length_line_2 = LengthLine(Line=warpweft.Warp, Length=multiplication_2, Strength=10)
merge_6 = Merge(Data1=length_line_2, Data2=length_line)

demesh = DeconstructMesh(Mesh=mesh)  # -> Vertices, Faces, Colours, Normals
load = Load(Point=demesh.Vertices, ForceVector=Vector(0, 0, 1), Weighting=Slider(0.098, range=0..1))

merge_7 = Merge(Data1=show, Data2=load, Data3=merge_6, Data4=anchor)  # -> flatten(Result)

zombiesolver = ZombieSolver(GoalObjects=merge_7, Threshold="0.00001", Tolerance=0.0001, MaxIterations=50000)  # -> I, V, O
clean = CleanTree(RemoveNulls=True, RemoveInvalid=True, RemoveEmpty=False, Tree=zombiesolver.O)
item_8 = ListItem(List=clean, Index=0, Wrap=True)

# ---- group: Mesh direction & stripes
gate = StreamGate(Stream=item_8, Gate=stripes_direction)  # -> Target0, Target1
turn = MeshTurn(Mesh=gate.Target1)
filter_3 = StreamFilter(Gate=stripes_direction, Stream0=gate.Target0, Stream1=turn)
stripper = Stripper(Mesh=filter_3)

# ---- group: Stripes VIZ
mesh_2 = Mesh(stripper)
lng_6 = ListLength(List=mesh_2)
panel = Panel("""0
1""")
swatch = ColourSwatch(SwatchColor=RGB(56, 56, 56))
swatch_2 = ColourSwatch(SwatchColor=RGB(255, 255, 255))
repeat = RepeatData(Data=panel, Length=lng_6)
weave_4 = Weave(Pattern=graft(repeat), Stream0=swatch, Stream1=swatch_2, NullGaps=False)
medges = MeshEdges(Mesh=mesh_2)  # -> NakedEdges, InteriorEdges, NonManifoldEdges
mcol_2 = MeshColours(Mesh=graft(mesh_2), Colours=graft(weave_4))
join_2 = JoinCurves(Curves=medges.NakedEdges, Preserve=False)
mjoin_2 = MeshJoin(Meshes=flatten(mcol_2))
swatch_3 = ColourSwatch(SwatchColor=RGB(0, 0, 0))
previewlw_2 = CustomPreviewLineweights(Geometry=join_2, Shader=swatch_3, Thickness=Slider(0.1, range=0..10), Absolute=Toggle(True))
preview_2 = CustomPreview(Geometry=mjoin_2, Shader=ColourSwatch(SwatchColor=RGB(150, 150, 150)))
