# Grasshopper definition Mesh topology & stripes.gh (Grasshopper 1.0.7)
# plug-ins: MeshEdit Components, Weaverbird, Kangaroo2 Components, Human

mesh = Mesh(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)
mesh_2 = Mesh(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)
mesh_3 = Mesh([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])
mesh_4 = Mesh(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)
mesh_5 = Mesh([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])
mesh_6 = Mesh([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])

# ----
# Mesh topology & stripes
# Temporary code by Andrea Graziano
# 
# © Co-de-iT 2023 _ Creative Commons Attribution-NonCommercial-ShareAlike 4.0 International License
mesh_7 = Mesh([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])
mesh_8 = Mesh(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)
mesh_9 = Mesh(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)
mesh_10 = Mesh([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])
entwine = Entwine(
    Branch00=mesh_7,
    Branch01=mesh_8,
    Branch02=mesh_9,
    Branch03=mesh_10,
    Branch04=mesh,
    Branch05=mesh_2,
    Branch06=mesh_3,
    Branch07=mesh_4,
    Branch08=mesh_5,
    Branch09=mesh_6,
    FlattenInputs=True)  # -> simplify(Result)
mjoin = MeshJoin(Meshes=entwine)
weldvertices = MeshWeldVertices(Mesh=mjoin, Tolerance=0.01)  # -> RuntimeMessage, Mesh
# N.B.  this definition uses the following plugins:
# - Meshedit2000 by uto
# - WeaverBird by Giulio Piacentino
# - Human by Andrew Heumann
wbcatmullclark = WeaverbirdsCatmullClarkSubdivision(MeshCurves=weldvertices.Mesh, Level="3", SmoothNakedEdges="1")
move = Move(Geometry=wbcatmullclark, Motion="0,-30,0")  # -> Geometry, Transform
mcol = MeshColours(Mesh=move.Geometry, Colours=ColourSwatch(SwatchColor=RGB(255, 255, 255)))
preview = CustomPreview(Geometry=mcol, Material=ColourSwatch(SwatchColor=RGB(0, 0, 0)))

stripper = Stripper(Mesh=move.Geometry)
move_2 = Move(Geometry=stripper, Motion="0,-30,0")  # -> Geometry, Transform

# ---- group: Assign colors
merge = Merge(Data1=ColourSwatch(SwatchColor=RGB(255, 255, 255)), Data2=ColourSwatch(SwatchColor=RGB(0, 0, 0)))
lng = ListLength(List=flatten(move_2.Geometry))
repeat = RepeatData(Data=merge, Length=lng)
mcol_2 = MeshColours(Mesh=graft(move_2.Geometry), Colours=graft(repeat))  # -> flatten(Mesh)
preview_2 = CustomPreview(Geometry=mcol_2, Material=ColourSwatch(SwatchColor=RGB(156, 156, 156)))

# ----
medges = MeshEdges(Mesh=stripper)  # -> NakedEdges, InteriorEdges, NonManifoldEdges
join = JoinCurves(Curves=medges.NakedEdges, Preserve=False)
swatch = ColourSwatch(SwatchColor=RGB(0, 0, 0))
previewlw = CustomPreviewLineweights(Geometry=join, Shader=swatch, Thickness=Slider(0.25, range=0..10), Absolute=Toggle(True))

explode = MeshExplode(Mesh=weldvertices.Mesh, Interpolate=False)
medges_2 = MeshEdges(Mesh=explode)  # -> NakedEdges, InteriorEdges, NonManifoldEdges
join_2 = JoinCurves(Curves=medges_2.NakedEdges, Preserve=False)
swatch_2 = ColourSwatch(SwatchColor=RGB(0, 0, 0))
previewlw_2 = CustomPreviewLineweights(Geometry=join_2, Shader=swatch_2, Thickness=Slider(0.25, range=0..10), Absolute=Toggle(True))
