# Grasshopper definition Non-Square Fibonacci spiral.gh (Grasshopper 1.0.7)
# plug-ins: Anemone, Human

# ---- group: X-Y dimensions
starting_x_size = Slider(2, range=0..10)
starting_y_size = Slider(1, range=0..10)

# ----
# Non-square Fibonacci spiral
# Temporary code by Andrea Graziano
# 
# © Co-de-iT 2023 _ Creative Commons Attribution-NonCommercial-ShareAlike 4.0 International License
number_slider = Slider(15, range=0..20)
xy = XYPlane(Origin=Point(0, 0, 0))
loop_start = LoopStart(N=number_slider, T=Button(), D0=xy, D3=starting_x_size, D4=starting_y_size, D5="0")  # -> port, Counter, Data, Data_2, Data_3, Data_4, Data_5, Data_6

# ---- group: Ratio
division = Division(A=starting_y_size, B=starting_x_size)

# ----
# N.B.  this definition uses the following plugins:
# - Anemone by Mateusz Zwierzycki
rectangle = Rectangle(Plane=loop_start.Data, XSize=loop_start.Data_4, YSize=loop_start.Data_5, Radius=0)  # -> Rectangle, Length

# ---- group: Next X-Y values
addition = Addition(A=loop_start.Data_5, B=loop_start.Data_6)
multiplication = Multiplication(A=addition, B=division)

# ---- group: Bezier curve
disc = Discontinuity(Curve=rectangle.Rectangle, Level=1)  # -> Points, Parameters
toggle = BooleanToggle(False)
item = ListItem(List=disc.Points, Index=0, Wrap=True)  # -> Item, Item1, Item2, Item3
number_slider_2 = Slider(1, range=0..1)
vec2pt = Vector2Pt(PointA=item.Item2, PointB=item.Item3, Unitize=toggle)  # -> Vector, Length
vec2pt_2 = Vector2Pt(PointA=item.Item, PointB=item.Item3, Unitize=toggle)  # -> Vector, Length
division_2 = Division(A=starting_x_size, B=starting_y_size)
division_3 = Division(A=vec2pt.Vector, B=division_2)
multiplication_2 = Multiplication(A=vec2pt_2.Vector, B=number_slider_2)
multiplication_3 = Multiplication(A=division_3, B=number_slider_2)
bzspan = BezierSpan(StartPoint=item.Item, StartTangent=multiplication_2, EndPoint=item.Item2, EndTangent=multiplication_3)  # -> Curve, Length, Domain

# ---- group: New rectagle plane
Y = UnitY(Factor=1)
X = UnitX(Factor=1)
orient = OrientDirection(Geometry=loop_start.Data, PointA=item.Item, DirectionA=Y, PointB=item.Item2, DirectionB=X)  # -> Geometry, Transform

# ----
merge = Merge(Data1=flatten(loop_start.Data_3), Data2=flatten(bzspan.Curve))
merge_2 = Merge(Data1=flatten(loop_start.Data_2), Data2=flatten(rectangle.Rectangle))
loop_end = LoopEnd(
    port=loop_start.port,
    Exit=False,
    Data=orient.Geometry,
    Data_2=merge_2,
    Data_3=merge,
    Data_4=addition,
    Data_5=multiplication,
    Data_6=loop_start.Data_4,
    TimeOutVal=0,
    pausedState=False,
    state="Constant output")  # -> D0, D1, D2, D3, D4, D5
number_slider_3 = Slider(4, range=0..10)
dash = DashPattern(Curve=loop_end.D1, Pattern="0.2,0.2")  # -> Dashes, Gaps
toggle_2 = BooleanToggle(False)
previewlw = CustomPreviewLineweights(
    Geometry=loop_end.D2,
    Shader=ColourSwatch(SwatchColor=RGB(0, 0, 0)),
    Thickness=expr("x*2", number_slider_3),
    Absolute=toggle_2)
previewlw_2 = CustomPreviewLineweights(Geometry=dash.Dashes, Shader=ColourSwatch(SwatchColor=RGB(176, 176, 176)), Thickness=number_slider_3, Absolute=toggle_2)
