# Grasshopper definition Non-regular 3D printing.gh (Grasshopper 1.0.7)

# Non-regular 3D printing
# Temporary code by Andrea Graziano
# 
# © Co-de-iT 2023 _ Creative Commons Attribution-NonCommercial-ShareAlike 4.0 International License
number_slider = Slider(50, range=0..100)
layer_height = Slider(2.2, range=0..10)
n_layers = Slider(16, range=0..100)
multiplication = Multiplication(A=n_layers, B="3")
pt = Point("0,0,0")
series = Series(Start=0, Step=layer_height, Count=multiplication)
cir = Circle(Plane=pt, Radius=number_slider)
range = Range(Domain=Domain(0, 1), Steps=expr("x-1", multiplication))
Z = UnitZ(Factor=series)
graph = GraphMapper(
    range,
    x0=0,
    x1=1,
    y0=0,
    y1=1,
    container_name="Bezier",
    cpx=[0, 0.3986347616, 0.7608695626, 1],
    cpy=[0.549855113, 1, 1, 0.7536231875])
move = Move(Geometry=cir, Motion=Z)  # -> Geometry, Transform
area = Area(Geometry=move.Geometry)  # -> Area, Centroid
# N.B.  this definition uses the following plugins:
# -
panel = Panel("0 to 100")
scale = Scale(Geometry=move.Geometry, Center=area.Centroid, Factor=graph)  # -> Geometry, Transform
random = Random(Range=panel, Number=n_layers, Seed=Slider(5, range=0..20), Integers=True)  # -> graft(Random)
partition = PartitionList(List=scale.Geometry, Size="3")
item = ListItem(List=partition, Index=0, Wrap=True)  # -> Item, Item1, Item2
max_min_n_points = Panel("3 to 12")
n_divisions = Panel("100")
random_2 = Random(Range=max_min_n_points, Number=Slider(20, range=0..100), Seed=random, Integers=True)
ma = MassAddition(Input=random_2)  # -> Result, PartialResults
divide = DivideCurve(Curve=item.Item, Count=n_divisions, Kinks=False)  # -> Points, Tangents, Parameters
divide_2 = DivideCurve(Curve=item.Item1, Count=n_divisions, Kinks=False)  # -> Points, Tangents, Parameters
divide_3 = DivideCurve(Curve=item.Item2, Count=n_divisions, Kinks=False)  # -> Points, Tangents, Parameters
smaller = SmallerThan(FirstNumber=ma.PartialResults, SecondNumber=n_divisions)  # -> SmallerThan, OrEqualTo
dispatch = Dispatch(List=ma.PartialResults, DispatchPattern=smaller.SmallerThan)  # -> ListA, ListB
index = ItemIndex(List=divide.Points, Item=divide.Points)
expression = Expression(x=dispatch.ListA, Expression="x-1")
item_2 = ListItem(List=reverse(index), Index=0, Wrap=True)
item_3 = ListItem(List=index, Index=0, Wrap=True)
merge = Merge(Data1=item_3, Data2=dispatch.ListA)
merge_2 = Merge(Data1=expression, Data2=item_2)
dom = ConstructDomain(DomainStart=merge, DomainEnd=merge_2)
subset = SubList(List=simplify(divide.Points), Domain=simplify(dom), Wrap=True)  # -> simplify(List), Index
subset_2 = SubList(List=simplify(divide_2.Points), Domain=simplify(dom), Wrap=True)  # -> simplify(List), Index
subset_3 = SubList(List=simplify(divide_3.Points), Domain=simplify(dom), Wrap=True)  # -> simplify(List), Index
merge_3 = Merge(Data1=subset.List, Data2=reverse(subset_2.List), Data3=subset_3.List)
nurbs = NurbsCurve(Vertices=flatten(merge_3), Degree=3, Periodic=False)  # -> Curve, Length, Domain
pline = PolyLine(Vertices=flatten(merge_3), Closed=False)
pipe = Pipe(Curve=nurbs.Curve, Radius=1, Caps=0)  # disabled
preview = CustomPreview(Geometry=nurbs.Curve, Material=ColourSwatch(SwatchColor=RGB(161, 161, 161)))
