# Grasshopper definition Smoothing a Network of Lines.gh (Grasshopper 1.0.7)
# plug-ins: Anemone, froGH, Kangaroo2 Components

# ---- group: Reference lenght of subdivision
number_slider = Slider(0.8, range=0..1)

# ---- group: 3D
crv = Curve([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])

# ---- group: 2D
crv_2 = Curve([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])

# ----
len = Length(Curve=crv_2)
division = Division(A=len, B=number_slider)
int = Integer(division)
divide = DivideCurve(Curve=crv_2, Count=int, Kinks=False)  # -> Points, Tangents, Parameters
pline = PolyLine(Vertices=divide.Points, Closed=False)
explode = Explode(Curve=pline, Recursive=True)  # -> flatten(Segments), Vertices
dupln = RemoveDuplicateLines(Lines=explode.Segments, Tolerance=0.01)
f_tln = Topologizer(LinesNetwork=dupln, Decimals=3)  # -> Points, LinePointsData, Point2PointsConnectivity, LineDirectionAtEachPoint
loop_start = LoopStart(Repeat=Slider(30, range=0..30), Trigger=Button(), Data=f_tln.Points)  # -> port, Counter, simplify(Data)
panel = Panel(loop_start.Counter)
item = ListItem(List=loop_start.Data, Index=f_tln.Point2PointsConnectivity, Wrap=True)
lng = ListLength(List=item)
pdecon = Deconstruct(Point=graft(loop_start.Data))  # -> XComponent, YComponent, ZComponent
pdecon_2 = Deconstruct(Point=item)  # -> XComponent, YComponent, ZComponent
multiplication = Multiplication(A=lng, B="5")

# ---- group: Selection of Fixed Points by the Order of the Nodes (order = number of connections at node)
lng_2 = ListLength(List=f_tln.Point2PointsConnectivity)
equals = Equality(FirstNumber=lng_2, SecondNumber="4")  # -> Equality, Inequality
equals_2 = Equality(FirstNumber=lng_2, SecondNumber="1")  # -> Equality, Inequality
equals_3 = Equality(FirstNumber=lng_2, SecondNumber="3")  # -> Equality, Inequality
or = GateOr(A=equals_2.Equality, B=equals_3.Equality, C=equals.Equality)

# ----
subtraction = Subtraction(A=pdecon_2.XComponent, B=pdecon.XComponent)
subtraction_2 = Subtraction(A=pdecon_2.YComponent, B=pdecon.YComponent)
subtraction_3 = Subtraction(A=pdecon_2.ZComponent, B=pdecon.ZComponent)
ma = MassAddition(Input=subtraction)  # -> Result, PartialResults
ma_2 = MassAddition(Input=subtraction_2)  # -> Result, PartialResults
ma_3 = MassAddition(Input=subtraction_3)  # -> Result, PartialResults
division_2 = Division(A=ma.Result, B=multiplication)
division_3 = Division(A=ma_2.Result, B=multiplication)
division_4 = Division(A=ma_3.Result, B=multiplication)
addition = Addition(A=pdecon.XComponent, B=division_2)
addition_2 = Addition(A=pdecon.YComponent, B=division_3)
addition_3 = Addition(A=pdecon.ZComponent, B=division_4)
pt = ConstructPoint(XCoordinate=addition, YCoordinate=addition_2, ZCoordinate=addition_3)  # -> flatten(Point)
weave = Weave(Pattern=or, Stream0=graft(pt), Stream1=graft(f_tln.Points), NullGaps=False)  # -> flatten(Weave)
loop_end = LoopEnd(port=loop_start.port, Exit=False, Data=weave, TimeOutVal=0, pausedState=False, state="Constant output")
item_2 = ListItem(List=loop_end, Index=f_tln.LinePointsData, Wrap=True)
item_3 = ListItem(List=item_2, Index=0, Wrap=True)  # -> Item, Item1
swatch = ColourSwatch(SwatchColor=RGB(0, 126, 255))
ln = Line(StartPoint=item_3.Item, EndPoint=item_3.Item1)  # -> flatten(Line)
dots = DotDisplay(Point=loop_end, Colour=swatch, Size=Slider(0.05, range=0..0.1))
preview = CustomPreview(Geometry=ln, Material=swatch)

# ----
# Smoothing a Network of Lines
# Temporary code by Andrea Graziano
# 
# © Co-de-iT 2023 _ Creative Commons Attribution-NonCommercial-ShareAlike 4.0 International License
number_slider_2 = Slider(0.1, range=0..0.1)
f_tln_2 = Topologizer(LinesNetwork=crv_2, Decimals=3)  # -> Points, LinePointsData, Point2PointsConnectivity, LineDirectionAtEachPoint
swatch_2 = ColourSwatch(SwatchColor=RGB(46, 46, 46))
dash = DashPattern(Curve=crv_2, Pattern="0.3")  # -> Dashes, Gaps
end = EndPoints(Curve=crv_2)  # -> Start, End
lng_3 = ListLength(List=f_tln_2.Point2PointsConnectivity)
# N.B.  this definition uses the following plugins:
# - Anemone by Mateusz Zwierzycki
# - froGH by Co-de-iT
dots_2 = DotDisplay(Point=[end.Start, end.End], Colour=swatch_2, Size=number_slider_2)
preview_2 = CustomPreview(Geometry=dash.Dashes, Material=swatch_2)

move = Move(Geometry=f_tln_2.Points, Motion="0,0.2,0")  # -> Geometry, Transform

tag = TextTag3D(Location=graft(move.Geometry), Text=lng_3, Size="0.5", Colour=swatch_2, Justification=8)
