# Grasshopper definition Space colonization algorithm.gh (Grasshopper 1.0.7)
# plug-ins: froGH, Anemone

rectangle = Rectangle(Plane=PlaneXY(0, 0, 0), XSize="100", YSize="100", Radius=0)  # -> Rectangle, Length
# Space colonization algorithm
# Temporary code by Andrea Graziano
# 
# © Co-de-iT 2023 _ Creative Commons Attribution-NonCommercial-ShareAlike 4.0 International License
# References
# https://medium.com/@jason.webb/space-colonization-algorithm-in-javascript-6f683b743dc5
# https://jasonwebb.io/2020/03/space-colonization-branching-experiments-in-javascript/
panel = Panel("80")
pop2d = Populate2D(Region=rectangle.Rectangle, Count="300", Seed=Slider(8, range=0..20))
# D0 Starting point
# D1 Attractors
# D2 Older nodes
# D3 Pruned attractors
# D4 Connecting lines
int = Integer(panel)
pt = Point(Point(48.96360073, 51.38652639, 0))
loop_start = LoopStart(N=int, T=Button(), D0=pt, D1=pop2d)  # -> port, Counter, simplify(Data), simplify(Data_2), simplify(Data_3), simplify(Data_4), flatten(Data_5)
panel_2 = Panel(loop_start.Counter)

# ---- group: Considered attractors
f_crtree = CreateRTree(SourceData=loop_start.Data_2)
avr = Average(Input=loop_start.Data_2)
f_ptssphrt = PointsInSphereRTree(SphereCenter=loop_start.Data, SearchRadius=Slider(10, range=0..10), RTree=f_crtree)  # -> Points, PointsIndices
cullpt = CullDuplicates(Points=flatten(f_ptssphrt.Points), Tolerance=0.1, CullMode=1)  # -> Points, Indices, Valence
lng = ListLength(List=flatten(cullpt.Points))
equals = Equality(FirstNumber=lng, SecondNumber="0")  # -> Equality, Inequality
filter = StreamFilter(Gate=equals.Inequality, Stream0=avr, Stream1=cullpt.Points)

# ----
# N.B.  this definition uses the following plugins:
# - Anemone by Mateusz Zwierzycki
# - froGH by Co-de-iT
toggle = BooleanToggle(True)
merge = Merge(Data1=flatten(loop_start.Data), Data2=flatten(loop_start.Data_3))
clean = CleanTree(RemoveNulls=toggle, RemoveInvalid=toggle, RemoveEmpty=toggle, Tree=merge)
cullpt_2 = CullDuplicates(Points=clean, Tolerance=0.1, CullMode=1)  # -> Points, Indices, Valence

cp = ClosestPoint(Point=filter, Cloud=cullpt_2.Points)  # -> ClosestPoint, CPIndex, Distance
cset = CreateSet(List=cp.CPIndex)  # -> Set, Map
item = ListItem(List=cullpt_2.Points, Index=cp.CPIndex, Wrap=True)
mindex = MemberIndex(Set=cp.CPIndex, Member=cset.Set)  # -> Index, Count
vec2pt = Vector2Pt(PointA=item, PointB=filter, Unitize=False)  # -> Vector, Length
item_2 = ListItem(List=filter, Index=mindex.Index, Wrap=True)
item_3 = ListItem(List=item, Index=mindex.Index, Wrap=True)
item_4 = ListItem(List=vec2pt.Vector, Index=mindex.Index, Wrap=True)

ln = Line(StartPoint=filter, EndPoint=cp.ClosestPoint)
dash = DashPattern(Curve=ln, Pattern="0.3")  # -> Dashes, Gaps

avr_2 = Average(Input=item_4)
amp = Amplitude(Vector=avr_2, Amplitude="1")
move = Move(Geometry=item_3, Motion=amp)  # -> Geometry, Transform

cir = Circle(Plane=item_2, Radius="1")
vdis = VectorDisplay(Anchor=item_3, Vector=amp)

dist = Distance(PointA=item_2, PointB=move.Geometry)
larger = LargerThan(FirstNumber=dist, SecondNumber="1")  # -> LargerThan, OrEqualTo
dispatch = Dispatch(List=move.Geometry, DispatchPattern=larger.OrEqualTo)  # -> flatten(ListA), flatten(ListB)
toggle_2 = BooleanToggle(True)
cullpt_3 = CullDuplicates(Points=dispatch.ListA, Tolerance=0.1, CullMode=1)  # -> Points, Indices, Valence
merge_2 = Merge(Data1=flatten(loop_start.Data_3), Data2=flatten(loop_start.Data), Data3=flatten(dispatch.ListB))
toggle_3 = BooleanToggle(True)
clean_2 = CleanTree(RemoveNulls=toggle_2, RemoveInvalid=toggle_2, RemoveEmpty=toggle_2, Tree=dispatch.ListB)
toggle_4 = BooleanToggle(True)
cp_2 = ClosestPoint(Point=clean_2, Cloud=loop_start.Data_2)  # -> ClosestPoint, CPIndex, Distance
clean_3 = CleanTree(RemoveNulls=toggle_3, RemoveInvalid=toggle_3, RemoveEmpty=toggle_3, Tree=cullpt_3.Points)
clean_4 = CleanTree(RemoveNulls=toggle_4, RemoveInvalid=toggle_4, RemoveEmpty=toggle_4, Tree=merge_2)
cull_i = CullIndex(List=loop_start.Data_2, Indices=cp_2.CPIndex, Wrap=True)
item_5 = ListItem(List=loop_start.Data_2, Index=cp_2.CPIndex, Wrap=True)
lng_2 = ListLength(List=cullpt_3.Points)
ln_2 = Line(StartPoint=item_3, EndPoint=move.Geometry)
lng_3 = ListLength(List=dispatch.ListB)
toggle_5 = BooleanToggle(True)
equals_2 = Equality(FirstNumber=lng_2, SecondNumber="0")  # -> Equality, Inequality
merge_3 = Merge(Data1=flatten(loop_start.Data_5), Data2=flatten(ln_2))
equals_3 = Equality(FirstNumber=lng_3, SecondNumber="0")  # -> Equality, Inequality
merge_4 = Merge(Data1=flatten(loop_start.Data_4), Data2=flatten(item_5))
filter_2 = StreamFilter(Gate=equals_3.Equality, Stream0=cull_i, Stream1=loop_start.Data_2)
clean_5 = CleanTree(RemoveNulls=toggle_5, RemoveInvalid=toggle_5, RemoveEmpty=toggle_5, Tree=merge_3)
loop_end = LoopEnd(
    port=loop_start.port,
    Exit=equals_2.Equality,
    Data=flatten(clean_3),
    Data_2=flatten(filter_2),
    Data_3=flatten(clean_4),
    Data_4=flatten(merge_4),
    Data_5=flatten(clean_5),
    TimeOutVal=0,
    pausedState=False,
    state="Constant output")  # -> D0, D1, D2, D3, D4
number_slider = Slider(0.25, range=0..1)
dots = DotDisplay(Point=loop_end.D0, Colour=ColourSwatch(SwatchColor=RGB(0, 255, 0)), Size=number_slider)
dots_2 = DotDisplay(Point=loop_end.D1, Colour=ColourSwatch(SwatchColor=RGB(112, 112, 112)), Size=number_slider)
dots_3 = DotDisplay(Point=loop_end.D2, Colour=ColourSwatch(SwatchColor=RGB(0, 95, 255)), Size=number_slider)
dots_4 = DotDisplay(Point=loop_end.D3, Colour=ColourSwatch(SwatchColor=RGB(255, 0, 112)), Size=number_slider)
preview = CustomPreview(Geometry=loop_end.D4, Material=ColourSwatch(SwatchColor=RGB(59, 59, 59)))
