# Grasshopper definition The importance of mesh vertices order.gh (Grasshopper 1.0.7)
# plug-ins: MeshEdit Components, Weaverbird, Kangaroo2 Components, Human

# The importance of mesh vertices order
# Temporary code by Andrea Graziano
# 
# © Co-de-iT 2023 _ Creative Commons Attribution-NonCommercial-ShareAlike 4.0 International License
mesh = Mesh([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])
explode = MeshExplode(Mesh=mesh, Interpolate=False)
demesh = DeconstructMesh(Mesh=explode)  # -> simplify(Vertices), Faces, Colours, Normals

# ---- group: Shifting the points lists
panel = Panel("""0
1""")
panel_2 = Panel("""0
1
2""")
crossref = CrossReference(ListA=panel, ListB=panel, ListC=panel_2, ListD=panel, CrossMode=1)  # -> ListA, ListB, ListC, ListD
entwine = Entwine(Branch00=crossref.ListA, Branch01=crossref.ListB, Branch02=crossref.ListC, Branch03=crossref.ListD, FlattenInputs=True)  # -> simplify(Result)
lng = ListLength(List=entwine)
dup = DuplicateData(Data=simplify(demesh.Faces), Number=lng, Order=True)  # -> simplify(graft(Data))
# N.B.  this definition uses the following plugins:
# - Meshedit2000 by uto
# - WeaverBird by Giulio Piacentino
# - Human by Andrew Heumann
shift = ShiftList(List=demesh.Vertices, Shift=entwine, Wrap=True)

# ----
conmesh = ConstructMesh(Vertices=shift, Faces=dup)
path_mapper = PathMapper(conmesh, source="{A;B}", target="{B}")
mjoin = MeshJoin(Meshes=path_mapper)
weldvertices = MeshWeldVertices(Mesh=mjoin, Tolerance=0.01)  # -> RuntimeMessage, Mesh
recgrid = Rectangular(Plane=PlaneXY(0, 0, 0), SizeX="50", SizeY="85", ExtentX="5", ExtentY="3")  # -> Cells, Points
vec2pt = Vector2Pt(PointA="0,16,0", PointB=recgrid.Points, Unitize=False)  # -> Vector, Length
move = Move(Geometry=weldvertices.Mesh, Motion=graft(vec2pt.Vector))  # -> Geometry, Transform
wbcatmullclark = WeaverbirdsCatmullClarkSubdivision(MeshCurves=move.Geometry, Level="3", SmoothNakedEdges="1")

explode_2 = MeshExplode(Mesh=move.Geometry, Interpolate=False)
faceb = FaceBoundaries(Mesh=explode_2)
demesh_2 = DeconstructMesh(Mesh=explode_2)  # -> Vertices, Faces, Colours, Normals
offset = OffsetCurve(Curve=faceb, Distance="-1.6", Corners=1)
index = ItemIndex(List=demesh_2.Vertices, Item=demesh_2.Vertices)
disc = Discontinuity(Curve=offset, Level=1)  # -> Points, Parameters
tag = TextTag3D(Location=disc.Points, Text=index, Size="1.8", Colour=ColourSwatch(SwatchColor=RGB(0, 119, 199)), Justification=5)

move_2 = Move(Geometry=wbcatmullclark, Motion="0,-25,0")  # -> Geometry, Transform
mcol = MeshColours(Mesh=move_2.Geometry, Colours=ColourSwatch(SwatchColor=RGB(255, 255, 255)))
preview = CustomPreview(Geometry=mcol, Material=ColourSwatch(SwatchColor=RGB(0, 0, 0)))
stripper = Stripper(Mesh=move_2.Geometry)
move_3 = Move(Geometry=stripper, Motion="0,-25,0")  # -> Geometry, Transform

explode_3 = MeshExplode(Mesh=move.Geometry, Interpolate=False)
medges = MeshEdges(Mesh=explode_3)  # -> NakedEdges, InteriorEdges, NonManifoldEdges
join = JoinCurves(Curves=medges.NakedEdges, Preserve=False)
swatch = ColourSwatch(SwatchColor=RGB(0, 0, 0))
previewlw = CustomPreviewLineweights(Geometry=join, Shader=swatch, Thickness=Slider(0.25, range=0..10), Absolute=Toggle(True))

# ---- group: Assign colors
merge = Merge(Data1=ColourSwatch(SwatchColor=RGB(255, 255, 255)), Data2=ColourSwatch(SwatchColor=RGB(0, 0, 0)))
lng_2 = ListLength(List=flatten(move_3.Geometry))
repeat = RepeatData(Data=merge, Length=lng_2)
mcol_2 = MeshColours(Mesh=graft(move_3.Geometry), Colours=graft(repeat))  # -> flatten(Mesh)
preview_2 = CustomPreview(Geometry=mcol_2, Material=ColourSwatch(SwatchColor=RGB(191, 191, 191)))

# ----
medges_2 = MeshEdges(Mesh=stripper)  # -> NakedEdges, InteriorEdges, NonManifoldEdges
join_2 = JoinCurves(Curves=medges_2.NakedEdges, Preserve=False)
swatch_2 = ColourSwatch(SwatchColor=RGB(0, 0, 0))
previewlw_2 = CustomPreviewLineweights(Geometry=join_2, Shader=swatch_2, Thickness=Slider(0.3, range=0..10), Absolute=Toggle(True))
